# Grasshopper definition Design Space Exploration of 3D Concrete Printed Bridges (generative&manual option).gh (Grasshopper 1.0.7)
# plug-ins: RhinoCodePluginGH

# ---- group: Manually turn of these components within the generative process
set_to_gen_when_running_database_overwri = ValueList({"Gen": 0, "toggles": 1}, selected="Gen")  # "Set to gen when running database overwritting the toggle values"
forced_member_sizes = BooleanToggle(False)
ps = BooleanToggle(False)

set_to_gen_when_running_database_overwri_2 = ValueList({"Gen": 0, "toggles": 1}, selected="Gen")  # "Set to gen when running database overwritting the toggle values"
forced_member_sizes_2 = BooleanToggle(False)
ps_2 = BooleanToggle(False)

# ---- group: structural properties
ratio_nefs = Slider(10, range=0..10)
n_printlayers_for_cc = Slider(2, range=0..10)
compressive_strength_n_mm2 = Slider(30, range=0..100)
youngs_modulus_n_mm2 = Slider(20000, range=0..100000)
tensile_strength_n_mm2 = Slider(3, range=0..30)
printlayer_width_mm = Slider(100, range=5..200)
initial_height_mm = Slider(50, range=0..100)
fixed_width_mm = Slider(1000, range=0..1000)
density_kg_m3 = Slider(2300, range=0..10000)
square_root = SquareRoot(Value=ratio_nefs)

# ---- group: control of variable design domains
stepsize_of_those_domain_variables = Slider(1, range=1..5)
amount_of_domain_variables = Slider(3, range=3..5)

# ---- group: Determine max allowable deflection
span_this_number_max_deflection = Slider(800, range=0..1000)

# ---- group: structural properties
ratio_nefs_2 = Slider(10, range=0..10)
n_printlayers_for_cc_2 = Slider(1, range=0..10)
compressive_strength_n_mm2_2 = Slider(30, range=0..100)
youngs_modulus_n_mm2_2 = Slider(20000, range=0..100000)
tensile_strength_n_mm2_2 = Slider(3, range=0..30)
initial_height_mm_2 = Slider(100, range=0..100)
fixed_width_mm_2 = Slider(500, range=0..1000)
density_kg_m3_2 = Slider(2300, range=0..10000)
printlayer_width = Slider(100, range=5..200)
square_root_2 = SquareRoot(Value=ratio_nefs_2)

# ---- group: model variables
threshhold_minimum_height_mm = Slider(1, range=0..100)
max_iterations = Slider(100, range=0..100)
damp_factor = Slider(0.15, range=0..1)
optimize_vmax = BooleanToggle(False)
penelization = BooleanToggle(True)
converging = BooleanToggle(True)
gravity = BooleanToggle(True)

# ---- group: 'Fixed' geometrical properties
distance_between_vertical_points = Slider(2, range=0..10)
amount_of_vertical_points = Slider(3, range=0..10)
subdivision = Slider(2, range=0..10)
subdivision_type = ValueList({"squares": 0, "crossref": 1}, selected="squares")

# ---- group: control of variable design domains
stepsize_of_those_domain_variables_2 = Slider(1, range=1..5)
amount_of_domain_variables_2 = Slider(3, range=3..5)

# ---- group: Determine max allowable deflection
span_this_number_max_deflection_2 = Slider(800, range=0..1000)

# ---- group: model variables
threshhold_minimum_height_mm_2 = Slider(10, range=0..100)
max_iterations_2 = Slider(50, range=0..100)
damp_factor_2 = Slider(0.15, range=0..1)
optimize_vmax_2 = BooleanToggle(True)
penelization_2 = BooleanToggle(True)
converging_2 = BooleanToggle(True)
gravity_2 = BooleanToggle(True)

# ---- group: Manually create 'generative' bridge
construction_constraint = ValueList({"None": 0, "Loadpath": 1, "Lmid": 2, "Ledge": 3}, selected="Lmid")
prestress_radius_mm = Slider(0, range=0..32)
variable_design_domain_heights = GenePool(Decimals=0, Maximum=3, Minimum=-3, Value=[1, 2, 3])
youngpen = ValueList({"None": 0, "Linear": 1, "Smooth": 2}, selected="Smooth")
beam_truss = ValueList({"beam": 0, "truss": 1}, selected="beam")

# ---- group: 'Fixed' geometrical properties
distance_between_vertical_points_2 = Slider(2, range=0..10)
amount_of_vertical_points_2 = Slider(3, range=0..10)
subdivision_2 = Slider(3, range=0..10)
subdivision_type_2 = ValueList({"squares": 0, "crossref": 1}, selected="squares")

# ----
load_kn_m = Slider(1, range=0..100)

# ---- group: OPTIONAL TO SET ADDITIONAL POINT LOAD
force_in_x = Slider(0, range=0..20)
force_in_y = Slider(0, range=0..20)

force_in_x_2 = Slider(0, range=0..20)
force_in_y_2 = Slider(0, range=0..20)

# ---- group: Set outputfile location
# Generative bridge design
panel = Panel("D:\Thesis excel files\output.json")
panel_2 = Panel("D:\Thesis excel files\input.json")

# ---- group: Turn write pandas off OR it wil overwrite
write_pandas_df = BooleanToggle(False)
enable_storage = BooleanToggle(True)
reset_storage = Button()

# ---- group: Create generative design options
construction_constraint_2 = Panel("""None
Loadpath
Ledge""")
prestress_radius_mm_2 = Panel("""0
25
32""")
load_kn = Panel("1")
youngpen_2 = Panel("""None
Linear
Smooth""")
manu = Panel("truss")

# ----
cluster = Cluster_7(A=distance_between_vertical_points, B=amount_of_domain_variables, B_2=span_this_number_max_deflection)
generative_design = GenerativeDesign_2(
    list=variable_design_domain_heights,
    index=youngpen,
    prestress=prestress_radius_mm,
    index_2=construction_constraint,
    index_3=beam_truss)  # -> length, result, i, result_2, i_2, i_3
cluster_2 = Cluster_9(
    _0_0=generative_design.i_3,
    _0_1=youngs_modulus_n_mm2,
    _0_2=initial_height_mm,
    A=n_printlayers_for_cc,
    B=printlayer_width_mm,
    d1=force_in_x,
    d2=force_in_y,
    x=generative_design.i_2,
    _1=forced_member_sizes,
    gate_2=set_to_gen_when_running_database_overwri,
    _1_2=ps,
    number_2=distance_between_vertical_points,
    x_2=generative_design.result_2,
    number=amount_of_vertical_points,
    y_component=generative_design.result,
    gate=subdivision_type,
    number_5=subdivision)  # -> _0_0_0, _0_1_0, _0_2_0, manup, x_component, y_component_2, i, item_1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
# Manual bridge design
script = Script(
    Yield_strength_compression=compressive_strength_n_mm2,
    Yield_strength_tension=tensile_strength_n_mm2,
    Youngs_modulus=youngs_modulus_n_mm2,
    Ratio_Nefs=square_root)  # -> out, optimized_s, d_result
# ---------- script: Python ----------
#import libraries
import numpy as np
from scipy.optimize import minimize
from scipy.special import expit
from scipy.optimize import check_grad

def equation(x: float, t:float, c:float, s:float , d:float ) -> float:
    """
    Sigmoid function for a given upper and lower yield strength

    :param c: yield strength in compresison
    :param t: yield strength in tension
    :param x: x of the curve (strain)
    :param s: Sigmoid control variable
    :param d: Sigmoid control variable

    :return: y of the curve (stress)
    """
    return  -t + (c + t) * expit(-1*s * (x - d))


def objective_s(s:float, *args) -> float:
    """
    the objective function returns the summed difference between the y values of a certain amount of points 
    on the sigmoid curve and bi-linear youngs modulus penalization

    :param c: yield strength in compresison
    :param t: yield strength in tension
    :param x: x of the curve (strain)
    :param s: Sigmoid control variable
    :param d: Sigmoid control variable

    :return: total distance between the points on both curves
    """
    t, c, E, x_values = args
    # Calculate d using the provided formula
    # d and s are dependant on each because the curve goes through 0,0 (this is therefore a known point and can be used to calculate the ratio between those two points)
    d = -1 * np.log(c / t) / s
    # Calculate the difference between the two curves
    difference = np.sum(np.maximum(0, np.abs(E * x_values) - equation(x_values, t, c, s, d)) ** 2
                                 + (np.abs(E * x_values) - equation(x_values, t, c, s, d)) ** 2)
    return difference

# Define some constants and parameters
c = Yield_strength_compression 
t = Yield_strength_tension
E = Youngs_modulus
num_points = 10


# Calculate upper and lower bounds for x_values
upper_bound_x = ( c / E )
lower_bound_x = -(t / (E/Ratio_Nefs))

# Create arrays of x_values for different cases
x_values_positive = np.linspace(0, upper_bound_x, num_points)
x_values_negative = np.linspace(lower_bound_x, 0, num_points)
x_values_eq = np.linspace(lower_bound_x, upper_bound_x * 2, 50)

# Calculate corresponding y_values for different cases
y_values_positive = E * x_values_positive
y_values_negative = (E / Ratio_Nefs) * x_values_negative

# Concatenate x, y values
x_values = np.concatenate((x_values_negative, x_values_positive))
y_values = np.concatenate((y_values_negative, y_values_positive))

# Initial guess for the sigmoid parameter s
s_initial_guess = -30000

# Use the minimize function to find the optimized value of s
result = minimize(objective_s, s_initial_guess, args=(t, c, E, x_values))

# Extract the optimized 's' value from the result and round it to an arbitrary 7 decimals
optimized_s = np.round(result.x,7)[0]

# Calculate d using the optimized s
d = -1 * np.log(c / t) / optimized_s
d_result = d
# ---------- end script ----------
rc = RhinoCode(
    x_threshold=threshhold_minimum_height_mm,
    density=density_kg_m3,
    Max_allowable_deflection=cluster,
    converging=converging,
    Max_iterations=max_iterations,
    damp_factor=damp_factor,
    gravity=gravity,
    PS=cluster_2.s_0,
    Forced_member_sizes=cluster_2.s_0_2,
    Optimize_vmax=optimize_vmax,
    Youngpen=penelization,
    Penalization=generative_design.i,
    optimized_s=script.optimized_s,
    d_result=script.d_result,
    Yield_C=compressive_strength_n_mm2,
    Yield_T=tensile_strength_n_mm2,
    Nefs_Ratio=square_root,
    PSmembers=cluster_2.index,
    A_prestress=generative_design.result_2,
    ManuP=cluster_2.manup,
    printwidth=printlayer_width_mm,
    Non_zero_members=cluster_2.list_b,
    DOFs=cluster_2._0_0_0,
    init_young=cluster_2._0_1_0,
    b=fixed_width_mm,
    init_height=cluster_2._0_2_0,
    xc=cluster_2.x_component,
    y=cluster_2.y_component_2,
    Bn1=flatten(cluster_2.i),
    Bn2=flatten(cluster_2.item_1),
    Length2=cluster_2.length_mm,
    Angles=cluster_2.degrees,
    SupportPoints=cluster_2.index_supportpoints,
    LoadMember=cluster_2.index_loadmembers,
    ForceDL=load_kn_m,
    Loadnode=cluster_2.index_loadnode_for_pointload,
    Forcevector=cluster_2.result)  # -> out, Heights, Forces, Epoch, TC, Vmax, Vmax_scale, Mean_dis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; inputs converging: Boolean, Max_iterations: Int32, damp_factor: Double, gravity: Boolean, PS: Boolean, Forced_member_sizes: Boolean, Optimize_vmax: Boolean, Penalization: String, PSmembers: list of Int32, A_prestress: Int32, ManuP: Int32, Non_zero_members: list of Int32, DOFs: list of String, init_young: list of Int32, b: list of Double, init_height: list of Double, xc: list of Double, y: list of Double, Bn1: list of Int32, Bn2: list of Int32, Length2: list of Double, Angles: list of Double, SupportPoints: list of Int32, LoadMember: list of Int32, ForceDL: Int32, Loadnode: list of Int32, Forcevector: list of Double
# ---------- rc: Python ----------
# import required libraries
import numpy as np
import math
from scipy.optimize import minimize
from scipy.special import expit
from scipy.optimize import root


# create class bridge
class Bridge:
    # initialize the variables
    def __init__(self, E, b, nodes, bars, dofs, Length, Angle, x):
        # Store number of elements and nodes
        self.ne = len(bars)
        self.nn = len(nodes)
        self.list_ne = range(self.ne)
        self.list_nn = range(self.nn)

        # Properties
        self.young = E.astype(np.float64) # Young's modulus
        self.Length = np.array(Length).astype(np.float64) # element lengths
        self.x = x.astype(np.float64) # Sectional height
        self.b = b # Sectional width
        self.vmax_scale = 1 #Maximum volume scaling factor
        self.PSforce = 1860 * A_prestress #Prestress force
        self.Secant = False #Boolean flasg

        # Geometry
        self.nodes = nodes.astype(int) # Node x,y
        self.bars = bars.astype(int) # Element-node indices
        self.dofs = np.array([3 if item == 'beam' else 2 for item in dofs]) # DOFs 3 for beam 2 for truss
        self.index_dofs = np.array([[0, 1, 2, 3, 4, 5] if item == 'beam' else [0, 1, 3, 4] for item in dofs])
        self.Angle = np.array([np.radians(angle) for angle in Angle]).astype(np.float64) #Angle of each beam

        # Section properties
        self.inertia = np.zeros_like(self.x).astype(np.float64)
        self.section = np.zeros_like(self.x).astype(np.float64)
        self.resistance = np.zeros([self.ne, 6]).astype(np.float64)
        self.vmax = np.sum(Length * init_height)

        # Boundary conditions
        self.support = np.ones([self.nn, 3]).astype(int)
        self.distributed_load = np.zeros([self.ne, 1]).astype(np.float64)
        self.support_forces = np.zeros([self.nn, 3]).astype(np.float64)

        # DOF  properties
        self.total_dofs = None
        self.AUX = None
        self.INDEX = None
        self.dofs_per_node = None

        # Run first function to find fixed geometrical and DOF properties
        self.calculate_dofs()

        # Containers for forces and displacements
        self.Epoch = [] # List to store epochs
        self.nodal_forces = np.zeros_like(self.AUX).astype(np.float64)
        self.applied_forces = np.zeros_like(self.AUX).astype(np.float64)
        self.local_displacement = np.zeros([self.ne, 6]).astype(np.float64)
        self.center = np.zeros([self.ne])  # Centers of elements
        self.strain = np.zeros([self.ne, 3]).astype(np.float64)
        self.tension = np.zeros([self.ne]) # Tension or compression in each element
        self.local_forces = np.zeros([self.ne, 6]).astype(np.float64)
        self.stress = np.zeros([self.ne, 6]).astype(np.float64)
        self.strain_energy = np.zeros([self.ne]).astype(np.float64)
        self.global_nodal_forces = np.zeros([self.nn, 3]).astype(np.float64)
        self.MSU = np.zeros([self.ne]) # Mean stress utilization

    def calculate_dofs(self) -> None:
        """
        Calculate the DOFs (Degrees of freedom) for each node and element in the bridge structure.

        This method computes the total number of DOFs, DOFs per node, and DOFs per element. It also prepares data structures
        to store DOF indices for nodes and elements. These are only calculated once and stored in the object and used
        throughout each iteration.

        :return: None
        """
        # initialize some containers
        AUX, INDEX, dpn, list_bar_to_node = [], [], [], []
        start = 0

        # FIND TOTAL DOFS BY FINDING AMOUNT PER NODE
        for i in range(self.nn):
            # Find indices of bars connected to current node
            indices_ofbarstonode = np.where((self.bars[:, 0] == i) | (self.bars[:, 1] == i))[0]
            list_bar_to_node.append(indices_ofbarstonode)
            dpn.append(np.max(self.dofs[indices_ofbarstonode]))
            self.dofs_per_node = np.array(dpn)
        self.total_dofs = np.sum(self.dofs_per_node)
        list_dofs = np.array(list(range(self.total_dofs)))

        # Assign DOFs to each node =  aux
        for elements in self.dofs_per_node:
            end = start + elements
            aux = list_dofs[start:end]
            AUX.append(aux)
            start = end
        self.AUX = np.array(AUX)

        # Assign DOFs to each element = INDEX
        for i in range(self.ne):
            index = [AUX[self.bars[i][0]], AUX[self.bars[i][1]]]
            if self.dofs[i] == 2:
                index = [sublist[:2] for sublist in index]
            index = [j for i in index for j in i]  # sum two sublists This method is faster than sum(sublist+sublist)
            INDEX.append(index)
        self.INDEX = np.array(INDEX)

        # Initialize nodal forces and displacements arrays
        self.nodal_forces = np.zeros([self.total_dofs])
        self.nodaldis = np.zeros([self.total_dofs])

    def analysis(self, x: np.ndarray[float]) -> np.ndarray[float]:
        """
        Perform structural analysis on the bridge.

        This method calculates the local and global element matrices, as well as the global stiffness matrix of the bridge
        structure based on the given sectional properties and geometric information.
        Then the direct stiffness method is imposed on that global stiffness matrix to derive the structural performance of the bridge.


        :param x: Numpy array representing the sectional height of each bridge element.

        :return: None

        """
        # Initialize containers
        Local_element_matrices, Transformation_matrices, SUPPORT, Global_element_matrices, Kp = [], [], [], [], []

        # Initialize matrices
        matrix6 = np.zeros([6, 6])
        Tmatrix6 = np.zeros([6, 6])
        matrix4 = np.zeros([4, 4])
        Tmatrix4 = np.zeros([4, 4])

        # Initializing global stiffnes matrix
        ss = np.zeros([self.total_dofs, self.total_dofs])
        # Determine sectional properties (done within the loop toabe to manipulate during opti)
        for i in self.list_ne:
            self.inertia[i] = (b * x[i] ** 3) / 12
            self.section[i] = x[i] * b
            self.resistance[i, (0, 3)], self.resistance[i, (1, 4)], self.resistance[i, (2, 5)] = self.section[i], 2.4 * \
                                                                                                                  self.section[
                                                                                                                      i], \
            self.inertia[i]
            self.center[i] = (self.nodes[self.bars[i, 0], 1] + self.nodes[self.bars[i, 1], 1]) / 2
            # DOFs for each element
            # Element stiffness matrix
            l = self.Length[i]
            c1 = (self.section[i] * self.young[i]) / self.Length[i]
            c2 = (self.inertia[i] * self.young[i]) / (self.Length[i] ** 3)

            if self.dofs[i] == 2:  # Only translational DOFs

                # Create local element matrix
                matrix4[0] = [c1, 0, -c1, 0]
                matrix4[1] = [0, 0, 0, 0]
                matrix4[2] = [-c1, 0, c1, 0]
                matrix4[3] = [0, 0, 0, 0]

                # Calculate (co)Sine for local-global transformation
                C = round(math.cos(self.Angle[i]), 5)
                S = round(math.sin(self.Angle[i]), 5)

                # Transformation matrix
                Tmatrix4[0] = [C, S, 0, 0]
                Tmatrix4[1] = [-S, C, 0, 0]
                Tmatrix4[2] = [0, 0, C, S]
                Tmatrix4[3] = [0, 0, -S, C]

                # Store local matrices
                Local_element_matrices.append(matrix4.copy())
                Transformation_matrices.append(Tmatrix4.copy())

            else:  # Translational and rotational DOFs

                # Create local element matrix
                matrix6[0] = [c1, 0, 0, -c1, 0, 0]
                matrix6[1] = [0, 12 * c2, 6 * l * c2, 0, -12 * c2, 6 * l * c2]
                matrix6[2] = [0, 6 * l * c2, c2 * 4 * (l ** 2), 0, c2 * -6 * l, c2 * 2 * (l ** 2)]
                matrix6[3] = [-c1, 0, 0, c1, 0, 0]
                matrix6[4] = [0, -12 * c2, -6 * l * c2, 0, 12 * c2, -6 * l * c2]
                matrix6[5] = [0, c2 * 6 * l, c2 * 2 * (l ** 2), 0, -6 * l * c2, c2 * 4 * (l ** 2)]

                # Calculate (co)Sine for local-global transformation
                C = round(math.cos(self.Angle[i]), 5)
                S = round(math.sin(self.Angle[i]), 5)

                # Transformation matrix
                Tmatrix6[0] = [C, S, 0, 0, 0, 0]
                Tmatrix6[1] = [-S, C, 0, 0, 0, 0]
                Tmatrix6[2] = [0, 0, 1, 0, 0, 0]
                Tmatrix6[3] = [0, 0, 0, C, S, 0]
                Tmatrix6[4] = [0, 0, 0, -S, C, 0]
                Tmatrix6[5] = [0, 0, 0, 0, 0, 1]

                # Store local matrices
                Local_element_matrices.append(matrix6.copy())
                Transformation_matrices.append(Tmatrix6.copy())
            # Calculate global element matrix
            global_element_matrix = np.matrix.transpose(Transformation_matrices[i]).dot(Local_element_matrices[i]).dot(
                Transformation_matrices[i])
            # Store global element matrix
            Global_element_matrices.append(global_element_matrix)
            # Add global element matrix to global stiffness matrix (ss)
            ss[np.ix_(self.INDEX[i], self.INDEX[i])] += global_element_matrix

        # Fixed support conditions
        for i in self.list_nn:
            support = self.support[i][:self.dofs_per_node[i]]
            SUPPORT.append(support)
        support_condition_per_dof = np.concatenate(SUPPORT)

        # Set forces back to starting values
        self.nodal_forces = self.applied_forces.copy()  # prevent adding the gravity/prestress of previous iteration to this iteration

        # Set prestress to 0
        F_prestress = np.zeros_like(self.nodal_forces).flatten()

        # add prestress to the structure
        if PS:  # Check if the element is a beam element
            Center_of_Gravity = np.sum(self.center * x * Length) / np.sum(x * Length)
            for i in Prestress_members:
                if self.dofs[i] == 3:
                    Psmoment = self.PSforce * np.cos(self.Angle[i]) * (Center_of_Gravity - self.center[i])  # Px*e
                    Psvector = np.array(
                        [self.PSforce, 0, -Psmoment, -self.PSforce, 0, Psmoment])  # -ps MOMENT ,PS MOMENT
                else:
                    Psvector = np.array([self.PSforce, 0, -self.PSforce, 0])
                Psvector_global = np.matrix.transpose(Transformation_matrices[i]).dot(Psvector)
                F_prestress[np.ix_(self.INDEX[i])] += Psvector_global

        # Adds Distributed load to the end nodes of an element
        eq_load_ele = np.zeros([self.ne, 6])
        if ForceDL != 0:
            for i in LoadMember:
                l: float = Length[i]
                Q: float = self.distributed_load[i, 0]
                eq_load_ele[i, 1] = -Q * l / 2
                eq_load_ele[i, 4] = -Q * l / 2
                if math.pi / 2 < self.Angle[i] < math.pi * 3 / 2:
                    eq_load_ele[i, 2] = Q * l ** 2 / 12
                    eq_load_ele[i, 5] = -Q * l ** 2 / 12
                else:
                    eq_load_ele[i, 2] = -Q * l ** 2 / 12
                    eq_load_ele[i, 5] = Q * l ** 2 / 12
                self.nodal_forces[self.bars[i, 0], :] += eq_load_ele[i, :len(self.AUX[self.bars[i, 0]])]
                self.nodal_forces[self.bars[i, 1], :] += eq_load_ele[i, 3:3 + len(self.AUX[self.bars[i, 1]])]

        # Adds nodal gravity to the structure
        if gravity:
            for i in self.list_ne:
                P = (-9.801 * density) * (
                            self.section[i] / 1000000)  # Density*volume*9.81 * angle to split into Px and Py
                S = round(math.sin(self.Angle[i]), 5)
                Py = P * S
                Gv1 = (Py * 0.5 * Length[i]) / (S * 1000) if S != 0 else 0
                Gv2 = abs(Py - Gv1) * -1
                if self.Angle[i] < math.pi:
                    self.nodal_forces[self.bars[i, 0], 1] += Gv2
                    self.nodal_forces[self.bars[i, 1], 1] += Gv1
                else:
                    self.nodal_forces[self.bars[i, 0], 1] += Gv1
                    self.nodal_forces[self.bars[i, 1], 1] += Gv2

        # Find free dofs and forces
        free_dof = np.nonzero(support_condition_per_dof)[0].flatten()
        Unrestrained_stiffness_matrix = ss[np.ix_(free_dof, free_dof)]
        Total_forces = self.nodal_forces.flatten() + F_prestress  # you can apply a moment force to a non rotating element
        Unconstrained_forces = Total_forces[free_dof]

        # Solve for displacements in various sorts
        Free_Displacements = np.linalg.solve(Unrestrained_stiffness_matrix, Unconstrained_forces)
        Displacements_vector = self.nodaldis.astype(float).flatten()
        Displacements_vector[free_dof] = Free_Displacements
        Nodal_displacements_matrix = Displacements_vector.reshape(self.nn, self.dofs[0])  # change self.dofs
        self.nodaldis = Nodal_displacements_matrix
        Element_displacement_matrix = np.concatenate(
            (Nodal_displacements_matrix[self.bars[:, 0]], Nodal_displacements_matrix[self.bars[:, 1]]), axis=1)

        # Determine the reaction forces
        self.nodal_force_global = ss.dot(Displacements_vector).reshape(self.nn, self.dofs[0])
        self.reaction_forces = self.nodal_force_global[SupportPoints]

        # Using the displacements solve for forces
        for i in self.list_ne:
            self.local_displacement[i, self.index_dofs[i]] = np.dot(Transformation_matrices[i],
                                                                    Element_displacement_matrix[i])
            self.local_forces[i, self.index_dofs[i]] = Local_element_matrices[i].dot(
                self.local_displacement[i, self.index_dofs[i]])
            # calculate the stresses
            self.stress[i, self.index_dofs[i]] = self.local_forces[i, self.index_dofs[i]] / self.resistance[
                i, self.index_dofs[i]]
            # calculate if an element is in tension or compression
            self.tension[i] = -1 if self.stress[i, 0] > 0 else 1
            # calculate the strain energy per element
            self.strain_energy[i] = np.sum(abs(self.stress[i, self.index_dofs[i]]) ** 2 * (
                        self.Length[i] * self.resistance[i, self.index_dofs[i]]) / 2 * self.young[i])
            # Calculate the stress utilization, depending on the normal force sign
            if self.stress[i, 0] < 0:
                self.MSU[i] = np.mean(abs(self.stress[i, self.index_dofs[i]] / Yieldstress[0, self.index_dofs[i]]))
            else:
                self.MSU[i] = np.mean(abs(self.stress[i, self.index_dofs[i]] / Yieldstress[1, self.index_dofs[i]]))
        return self.strain_energy

    def youngpen(self, x: np.ndarray[float]) -> np.ndarray[float]:
        """
        Adjust the Young's modulus of each bridge element based on stresses in the element

        This method updates the Young's modulus of each element in the bridge structure based on the applied stress and the
        chosen penalization type (Nefs (Linear) or Secant (Smooth)). It calculates the updated Young's modulus to represent either a
        constant ratio of the original Young's modulus (Linear) or a secant modulus based on the Sigmoid stress-strain curve (Smooth).

        :param x: Numpy array containing the sectional heights

        :return: Updated Young's modulus values for each bridge element.
        """
        def F(x, a, b, t, c, s, d):
            """
            distance between a point on Linear curve and Smooth curve
            :param x: x on the curve
            :param a: x of the point location to be optimized towards
            :param b: y of the point location to be optimized towards
            :param t: Yield strength in tension
            :param c: Yield strength in compression
            :param s: Smooth function control variable, calculated in Smooth code
            :param d: Smooth function control variable, calculated in Smooth code

            :return: distance between functions
            """
            return (x - a) ** 2 + (equation(x, t, c, s, d) - b) ** 2

        def deriv_equation(x, t, c, s, d):
            """
            Derivative of sigmoid function
            """
            return s * (c + t) * expit(s * (d + x)) * (1 - expit(s * (d - x)))  # result

        def solve_distance(x, a, b, t, c, s, d):
            """
            Derivative of F, used to guide to optimization.
            """
            return 2 * (x - a) + 2 * (equation(x, t, c, s, d) - b) * deriv_equation(x, t, c, s, d)

        def equation(x, t, c, s, d):
            """
            Standard Sigmoid function with yield stress bounds c,t
            """
            return -t + (c + t) * expit(-1 * s * (x - d))

        # constant | for given material props
        Yield_compression = Yield_C
        Yield_tension = Yield_T
        S = optimized_s
        d = d_result

        # Find corresponding force and strain
        for i in self.list_ne:

            # Linear penalization
            if Penalization == 'Linear':
                if self.tension[i] == 1:
                    self.young[i] = Emin / Nefs_Ratio

            # Smooth penalization
            elif Penalization == 'Smooth':
                # find stresses in elements
                y_stress = self.stress[i, 0]
                # Set bound to stress values
                if y_stress > Yield_compression * 0.99:
                    y_stress = Yield_compression * 0.99
                elif y_stress < -Yield_tension:
                    y_stress = Yield_tension * 0.99

                # estimate strain
                x_strain = y_stress / self.young[i]

                # find strain on the curve given the stress
                x_result = minimize(F, x_strain, args=(x_strain, y_stress, Yield_tension, Yield_compression,
                                                       S, d), jac=solve_distance, method='TNC').x
                # find the stress on the curve given the strain
                y_result = equation(x_result, Yield_tension, Yield_compression, S, d)

                # Derive the youngs modulus as the secant between stress and strain
                self.young[i] = abs(y_result / x_result)
            else:
                self.young = E
        return self.young

    def objective(self, vmax_scale: float, x_percentage: np.ndarray[float], Max_allowable_deflection:float) -> float:
        """
        Objective function to calculate the differnce between the maximum occuring delfection and the maximum allowable deflection

        This method calculates the maximum occurring deflection of the bridge for a given scaling factor vmax_scale of
        the sectional areas. It then computes the difference between the maximum allowable deflection and the maximum
        occurring deflection. The optimization process aims to minimize this difference.

        :param vmax_scale: Scaling factor for the sectional areas
        :param x_percentage: Percentage of the maximum volume each element is allowed to use.
        :param Max_allowable_deflection: Maximum allowable deflection for the bridge.

        :return: The difference between the maximum allowable deflection and the maximum occurring deflection.
        """
        if vmax_scale < 0:
            return 1000  #Return a high value as a penalty for invalid scaling factors
        x = x_percentage * self.vmax * vmax_scale / self.Length
        # run the analysis with the sectional heights to find the deflection
        bridge.analysis(x)
        # derive the calculated deflection
        Max_occuring_deflection = max(max(abs(self.nodaldis[:, 1])), max(abs(self.nodaldis[:, 0])))
        return Max_allowable_deflection - Max_occuring_deflection # desired to be 0

    def find_vmax(self, x_percentage: np.ndarray[float], vmax: float, Max_allowable_deflection: float) -> float:
        """
        Finds the optimal scaling factor vmax_scale to minimize deflection.

        This method performs an optimization process to find the optimal scaling factor vmax_scale for the element sectional
        areas that minimizes, preferably roots, the difference between the maximum allowable deflection and the maximum occurring deflection of the
        bridge.

        :param vmax_scale: Scaling factor for the sectional areas
        :param x_percentage: Percentage of the maximum volume each element is allowed to use.
        :param Max_allowable_deflection: Maximum allowable deflection for the bridge.

        :return: The optimal maximum volume scaling factor
            """
        vmax_scale = 1 # Initial scaling factor
        vmax_init = vmax_scale
        result = root(self.objective, x0=vmax_init, args=(x_percentage, Max_allowable_deflection), method='hybr')
        return result.x # Return the optimal scaling factor

    def forced_members(self, StrainEi: np.ndarray[float], StrainE:float) -> np.ndarray[float]:
        """
        Set a minium sectional height to desired elements by fictively boosting their strain energy.

        This method adjusts the strain energy of specific bridge elements to reach a certain amount of minimum printlayers.
        This, while keeping the overall strain energy of the bridge the same.

        :param StrainEi: Numpy array representing the strain energy of each bridge element.
        :param StrainE: Total strain energy in the system

        :return: Numpy array of the adjusted strain energy values.
        """
        # initalize variable
        E_delta = 0

        # run over the elements
        for i in self.list_ne:
            # continue for CC members
            if i in Non_zero_members:
                # Calculate the strain energy threshold
                E_threshold = ManuP * StrainE * Length[i] / self.vmax
                # if below the threshold update it to the threshhold
                if StrainEi[i] < E_threshold:
                    E_delta += E_threshold - StrainEi[i]
                    StrainEi[i] = E_threshold
        # calculate the reduction factor to retain energy in the system
        E_scalar = ((StrainE - E_delta) / StrainE)

        # apply reduces strain energy for all non CC members based on E_scalar
        for i in self.list_ne:
            if i not in Non_zero_members:
                StrainEi[i] = StrainEi[i] * E_scalar
        return StrainEi

    def optimize_x(self, x:np.ndarray[float]) -> np.ndarray[float]:
        """
        Optimize the dimensions of bridge elements to meet strain energy and material constraints.

        This method iteratively optimizes the dimensions (sectional height) of bridge elements to achieve a target strain energy
            while considering material constraints and convergence criteria. The optimization process may also adjust the scaling factor
            for element lengths (`vmax_scale`) if `Optimize_vmax` is enabled.

            Parameters:
            - x: Numpy array representing the initial dimensions (sectional heights) of bridge elements.

            Returns:
            - Numpy array: Optimized dimensions (sectional heights) of bridge elements.
        """
        # initialize later used variables
        iteration = 0
        x_new, x_damped = np.zeros(self.ne), np.zeros(self.ne)
        converged = False

        # Strain Energy optimization!
        while iteration != Max_iterations and not converged:
            # Do analysis
            self.analysis(x)

            # Update youngs modulus
            if Youngpen:
                self.youngpen(x)

            # retrieve strain energy
            StrainEi = self.strain_energy  # rotation = factor 3 higher than strainE therefore only contributing
            StrainE = np.sum(StrainEi)

            # Apply CC
            if Forced_member_sizes:
                StrainEi = self.forced_members(StrainEi, StrainE)

            # update strain energy and store
            StrainE = np.sum(StrainEi)
            self.Epoch.append(StrainE)

            # Calculate New section areas based on strain Energy!
            x_percentage = (StrainEi / StrainE)
            x_new = (x_percentage * self.vmax) / Length  # b taken out constant for all members

            #check if the structure converged
            if converging and iteration > 0:
                # convergence stopping criterea
                if abs(self.Epoch[iteration] - self.Epoch[iteration - 1]) < conv_tolerance_rate * self.Epoch[iteration]:
                    print('converged in {} iterations'.format(iteration))
                    converged = True

                # calculate the damped version of x
                x_damped = x + ((x_new - x)* (1 - damp_factor)) 
                x = x_damped
            else:
                x = x_new
            # x values below the threshold are updated to the threshhold
            x[x <= x_threshold] = x_threshold
            iteration += 1

        # Vmax optimization!
        vmax_scale = 1  # reference vmax_Scale so that it does not error when Optimizevmax = false
        if Optimize_vmax:

            # set youngs modulus back to normal properties
            self.young = E

            # find vmax_scale so that maximum allowable deflection = maximum occuring deflection
            self.vmax_scale = self.find_vmax(x_percentage, self.vmax, Max_allowable_deflection)[0]

            # update the sectional heights with vmax scale
            x_vmax = x * self.vmax_scale

            # Make sure CC member still have their desired minimum height
            if Forced_member_sizes:
                for i in Non_zero_members:
                    if x_vmax[i] < ManuP:
                        x_vmax[i] = ManuP
            x = x_vmax
        # Do final analysis with last value of x
        bridge.analysis(x)

        # Remove all members below the threshold values
        x[x <= x_threshold * self.vmax_scale] = 0
        return x


# Element connectivity
conv_tolerance_rate = 1e-5
E = np.array(init_young)
x = np.array(init_height)
b = np.array(b)
Prestress_members = np.array(PSmembers)
nodes = np.array([[xc[index], y[index]] for index, _ in enumerate(y)], dtype="f")
bars = np.array([[Bn1[index], Bn2[index]] for index, _ in enumerate(Bn1)])
Non_zero_members2 = np.array(Non_zero_members)
Length = np.array(Length2, dtype="f")
Emin = E[0]
Angle = np.array(Angles, dtype='f')

# Create beam object
bridge = Bridge(E, b, nodes, bars, DOFs, Length, Angle, x)

# forces and boundary conditions
distributed_load_1 = bridge.distributed_load
distributed_load_1[LoadMember] = np.array([ForceDL * 1000])
nodal_force_1 = bridge.applied_forces
if bridge.dofs[Loadnode] == 2:
    nodal_force_1[Loadnode] = (Forcevector[0] * 1000, Forcevector[1] * 1000)
elif bridge.dofs[Loadnode] == 3:
    nodal_force_1[Loadnode] = (Forcevector[0] * 1000, Forcevector[1] * 1000, 0)

# Assign support conditions
support_1 = bridge.support
support_1[SupportPoints[0], (0, 1)] = 0
support_1[SupportPoints[1], 1] = 0

# Calculate yield stress vectors.
Yield_compression = 30
Yield_tension = 3
Yield_shear = 0.1 * math.sqrt(Yield_compression)
flexure_strength = 0.7 * math.sqrt(Yield_compression)
Yieldstress = np.array(
    [[Yield_compression, Yield_shear, flexure_strength, Yield_compression, Yield_shear, flexure_strength],
     [Yield_tension, Yield_shear, flexure_strength, Yield_tension, Yield_shear, flexure_strength]])

# Perform analysis
bridge.analysis(x)

# Perform optimization
Heights = bridge.optimize_x(x)

# Retrieve desired output from bridge class
TC = bridge.tension
Epoch = np.array(bridge.Epoch)
Max_def = np.max(abs(bridge.nodaldis[:, 1]))
Mean_dis = np.mean(bridge.nodaldis)
SF_v = sum(abs(bridge.reaction_forces[:, 1]))
SF_h = sum(abs(bridge.reaction_forces[:, 0]))
Vmax_scale = bridge.vmax_scale
Vmax = sum(Heights * Length * b)
MPU = np.mean(Heights / printwidth)
MSU = np.mean(bridge.MSU.astype(float))
Forces = bridge.local_forces[:, 0]
nodaldisplacements = bridge.nodaldis
# ---------- end rc ----------

# ---- group: check convergence of bridge
maximum_allowable_displacement = Panel(cluster)
vmax_scale = Panel(rc.Vmax_scale)
maximum_occuring_displacement = Panel(rc.Max_def)

# ---- group: Control data gathering
control_data_gathering_use_animate = Slider(1, range=0..5831)
set_to_large_value = Slider(15552, range=0..100000)
series = Series(Start=0, Step=1, Count=set_to_large_value)
list_item = ListItem(List=series, Index=control_data_gathering_use_animate, Wrap=True)

# ----
cluster_3 = Cluster_7(A=distance_between_vertical_points_2, B=amount_of_domain_variables_2, B_2=span_this_number_max_deflection_2)
generative_design_2 = GenerativeDesign(
    value=amount_of_domain_variables_2,
    step=stepsize_of_those_domain_variables_2,
    youngpen=youngpen_2,
    prestress=prestress_radius_mm_2,
    printlayers=construction_constraint_2,
    beam_truss=manu,
    index=list_item)  # -> length, result, i, result_2, i_2, i_3
cluster_4 = Cluster_6(
    _0_0=generative_design_2.i_3,
    _0_1=youngs_modulus_n_mm2_2,
    _0_2=initial_height_mm_2,
    A=n_printlayers_for_cc_2,
    B=printlayer_width,
    d1=force_in_x_2,
    d2=force_in_y_2,
    x=generative_design_2.i_2,
    _1=forced_member_sizes_2,
    gate_2=set_to_gen_when_running_database_overwri_2,
    _1_2=ps_2,
    number_2=distance_between_vertical_points_2,
    x_2=generative_design_2.result_2,
    number=amount_of_vertical_points_2,
    y_component=generative_design_2.result,
    gate=subdivision_type_2,
    number_5=subdivision_2)  # -> _0_0_0, _0_1_0, _0_2_0, manup, x_component, y_component_2, i, item_1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
script_2 = Script(
    Yield_strength_compression=compressive_strength_n_mm2_2,
    Yield_strength_tension=tensile_strength_n_mm2_2,
    Youngs_modulus=youngs_modulus_n_mm2_2,
    Ratio_Nefs=square_root_2)  # -> out, optimized_s, d_result; same code as script
rc_2 = RhinoCode(
    x_threshold=threshhold_minimum_height_mm_2,
    density=density_kg_m3_2,
    Max_allowable_deflection=cluster_3,
    converging=converging_2,
    Max_iterations=max_iterations_2,
    damp_factor=damp_factor_2,
    gravity=gravity_2,
    PS=cluster_4.s_0,
    Forced_member_sizes=cluster_4.s_0_2,
    Optimize_vmax=optimize_vmax_2,
    Youngpen=penelization_2,
    Penalization=generative_design_2.i,
    optimized_s=script_2.optimized_s,
    d_result=script_2.d_result,
    Yield_C=compressive_strength_n_mm2_2,
    Yield_T=tensile_strength_n_mm2_2,
    Nefs_Ratio=square_root_2,
    PSmembers=cluster_4.index,
    A_prestress=generative_design_2.result_2,
    ManuP=cluster_4.manup,
    printwidth=printlayer_width,
    Non_zero_members=cluster_4.list_b,
    DOFs=cluster_4._0_0_0,
    init_young=cluster_4._0_1_0,
    b=fixed_width_mm_2,
    init_height=cluster_4._0_2_0,
    xc=cluster_4.x_component,
    y=cluster_4.y_component_2,
    Bn1=flatten(cluster_4.i),
    Bn2=flatten(cluster_4.item_1),
    Length2=cluster_4.length_mm,
    Angles=cluster_4.degrees,
    SupportPoints=cluster_4.index_supportpoints,
    LoadMember=cluster_4.index_loadmembers,
    ForceDL=load_kn,
    Loadnode=cluster_4.index_loadnode_for_pointload,
    Forcevector=cluster_4.result)  # -> out, Heights, Forces, Epoch, TC, Vmax, Vmax_scale, Mean_dis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; inputs converging: Boolean, Max_iterations: Int32, damp_factor: Double, gravity: Boolean, PS: Boolean, Forced_member_sizes: Boolean, Optimize_vmax: Boolean, Penalization: String, PSmembers: list of Int32, A_prestress: Int32, ManuP: Int32, Non_zero_members: list of Int32, DOFs: list of String, init_young: list of Int32, b: list of Double, init_height: list of Double, xc: list of Double, y: list of Double, Bn1: list of Int32, Bn2: list of Int32, Length2: list of Double, Angles: list of Double, SupportPoints: list of Int32, LoadMember: list of Int32, ForceDL: Int32, Loadnode: list of Int32, Forcevector: list of Double
# ---------- rc_2: Python ----------
# import required libraries
import numpy as np
import math
from scipy.optimize import minimize
from scipy.special import expit
from scipy.optimize import root


# create class bridge
class Bridge:
    # initialize the variables
    def __init__(self, E, b, nodes, bars, dofs, Length, Angle, x):
        # Store number of elements and nodes
        self.ne = len(bars)
        self.nn = len(nodes)
        self.list_ne = range(self.ne)
        self.list_nn = range(self.nn)

        # Properties
        self.young = E.astype(np.float64) # Young's modulus
        self.Length = np.array(Length).astype(np.float64) # element lengths
        self.x = x.astype(np.float64) # Sectional height
        self.b = b # Sectional width
        self.vmax_scale = 1 #Maximum volume scaling factor
        self.PSforce = 1860 * A_prestress #Prestress force
        self.Secant = False #Boolean flasg

        # Geometry
        self.nodes = nodes.astype(int) # Node x,y
        self.bars = bars.astype(int) # Element-node indices
        self.dofs = np.array([3 if item == 'beam' else 2 for item in dofs]) # DOFs 3 for beam 2 for truss
        self.index_dofs = np.array([[0, 1, 2, 3, 4, 5] if item == 'beam' else [0, 1, 3, 4] for item in dofs])
        self.Angle = np.array([np.radians(angle) for angle in Angle]).astype(np.float64) #Angle of each beam

        # Section properties
        self.inertia = np.zeros_like(self.x).astype(np.float64)
        self.section = np.zeros_like(self.x).astype(np.float64)
        self.resistance = np.zeros([self.ne, 6]).astype(np.float64)
        self.vmax = np.sum(Length * init_height)

        # Boundary conditions
        self.support = np.ones([self.nn, 3]).astype(int)
        self.distributed_load = np.zeros([self.ne, 1]).astype(np.float64)
        self.support_forces = np.zeros([self.nn, 3]).astype(np.float64)

        # DOF  properties
        self.total_dofs = None
        self.AUX = None
        self.INDEX = None
        self.dofs_per_node = None

        # Run first function to find fixed geometrical and DOF properties
        self.calculate_dofs()

        # Containers for forces and displacements
        self.Epoch = [] # List to store epochs
        self.nodal_forces = np.zeros_like(self.AUX).astype(np.float64)
        self.applied_forces = np.zeros_like(self.AUX).astype(np.float64)
        self.local_displacement = np.zeros([self.ne, 6]).astype(np.float64)
        self.center = np.zeros([self.ne])  # Centers of elements
        self.strain = np.zeros([self.ne, 3]).astype(np.float64)
        self.tension = np.zeros([self.ne]) # Tension or compression in each element
        self.local_forces = np.zeros([self.ne, 6]).astype(np.float64)
        self.stress = np.zeros([self.ne, 6]).astype(np.float64)
        self.strain_energy = np.zeros([self.ne]).astype(np.float64)
        self.global_nodal_forces = np.zeros([self.nn, 3]).astype(np.float64)
        self.MSU = np.zeros([self.ne]) # Mean stress utilization

    def calculate_dofs(self) -> None:
        """
        Calculate the DOFs (Degrees of freedom) for each node and element in the bridge structure.

        This method computes the total number of DOFs, DOFs per node, and DOFs per element. It also prepares data structures
        to store DOF indices for nodes and elements. These are only calculated once and stored in the object and used
        throughout each iteration.

        :return: None
        """
        # initialize some containers
        AUX, INDEX, dpn, list_bar_to_node = [], [], [], []
        start = 0

        # FIND TOTAL DOFS BY FINDING AMOUNT PER NODE
        for i in range(self.nn):
            # Find indices of bars connected to current node
            indices_ofbarstonode = np.where((self.bars[:, 0] == i) | (self.bars[:, 1] == i))[0]
            list_bar_to_node.append(indices_ofbarstonode)
            dpn.append(np.max(self.dofs[indices_ofbarstonode]))
            self.dofs_per_node = np.array(dpn)
        self.total_dofs = np.sum(self.dofs_per_node)
        list_dofs = np.array(list(range(self.total_dofs)))

        # Assign DOFs to each node =  aux
        for elements in self.dofs_per_node:
            end = start + elements
            aux = list_dofs[start:end]
            AUX.append(aux)
            start = end
        self.AUX = np.array(AUX)

        # Assign DOFs to each element = INDEX
        for i in range(self.ne):
            index = [AUX[self.bars[i][0]], AUX[self.bars[i][1]]]
            if self.dofs[i] == 2:
                index = [sublist[:2] for sublist in index]
            index = [j for i in index for j in i]  # sum two sublists This method is faster than sum(sublist+sublist)
            INDEX.append(index)
        self.INDEX = np.array(INDEX)

        # Initialize nodal forces and displacements arrays
        self.nodal_forces = np.zeros([self.total_dofs])
        self.nodaldis = np.zeros([self.total_dofs])

    def analysis(self, x: np.ndarray[float]) -> np.ndarray[float]:
        """
        Perform structural analysis on the bridge.

        This method calculates the local and global element matrices, as well as the global stiffness matrix of the bridge
        structure based on the given sectional properties and geometric information.
        Then the direct stiffness method is imposed on that global stiffness matrix to derive the structural performance of the bridge.


        :param x: Numpy array representing the sectional height of each bridge element.

        :return: None

        """
        # Initialize containers
        Local_element_matrices, Transformation_matrices, SUPPORT, Global_element_matrices, Kp = [], [], [], [], []

        # Initialize matrices
        matrix6 = np.zeros([6, 6])
        Tmatrix6 = np.zeros([6, 6])
        matrix4 = np.zeros([4, 4])
        Tmatrix4 = np.zeros([4, 4])

        # Initializing global stiffnes matrix
        ss = np.zeros([self.total_dofs, self.total_dofs])
        # Determine sectional properties (done within the loop toabe to manipulate during opti)
        for i in self.list_ne:
            self.inertia[i] = (b * x[i] ** 3) / 12
            self.section[i] = x[i] * b
            self.resistance[i, (0, 3)], self.resistance[i, (1, 4)], self.resistance[i, (2, 5)] = self.section[i], 2.4 * \
                                                                                                                  self.section[
                                                                                                                      i], \
            self.inertia[i]
            self.center[i] = (self.nodes[self.bars[i, 0], 1] + self.nodes[self.bars[i, 1], 1]) / 2
            # DOFs for each element
            # Element stiffness matrix
            l = self.Length[i]
            c1 = (self.section[i] * self.young[i]) / self.Length[i]
            c2 = (self.inertia[i] * self.young[i]) / (self.Length[i] ** 3)

            if self.dofs[i] == 2:  # Only translational DOFs

                # Create local element matrix
                matrix4[0] = [c1, 0, -c1, 0]
                matrix4[1] = [0, 0, 0, 0]
                matrix4[2] = [-c1, 0, c1, 0]
                matrix4[3] = [0, 0, 0, 0]

                # Calculate (co)Sine for local-global transformation
                C = round(math.cos(self.Angle[i]), 5)
                S = round(math.sin(self.Angle[i]), 5)

                # Transformation matrix
                Tmatrix4[0] = [C, S, 0, 0]
                Tmatrix4[1] = [-S, C, 0, 0]
                Tmatrix4[2] = [0, 0, C, S]
                Tmatrix4[3] = [0, 0, -S, C]

                # Store local matrices
                Local_element_matrices.append(matrix4.copy())
                Transformation_matrices.append(Tmatrix4.copy())

            else:  # Translational and rotational DOFs

                # Create local element matrix
                matrix6[0] = [c1, 0, 0, -c1, 0, 0]
                matrix6[1] = [0, 12 * c2, 6 * l * c2, 0, -12 * c2, 6 * l * c2]
                matrix6[2] = [0, 6 * l * c2, c2 * 4 * (l ** 2), 0, c2 * -6 * l, c2 * 2 * (l ** 2)]
                matrix6[3] = [-c1, 0, 0, c1, 0, 0]
                matrix6[4] = [0, -12 * c2, -6 * l * c2, 0, 12 * c2, -6 * l * c2]
                matrix6[5] = [0, c2 * 6 * l, c2 * 2 * (l ** 2), 0, -6 * l * c2, c2 * 4 * (l ** 2)]

                # Calculate (co)Sine for local-global transformation
                C = round(math.cos(self.Angle[i]), 5)
                S = round(math.sin(self.Angle[i]), 5)

                # Transformation matrix
                Tmatrix6[0] = [C, S, 0, 0, 0, 0]
                Tmatrix6[1] = [-S, C, 0, 0, 0, 0]
                Tmatrix6[2] = [0, 0, 1, 0, 0, 0]
                Tmatrix6[3] = [0, 0, 0, C, S, 0]
                Tmatrix6[4] = [0, 0, 0, -S, C, 0]
                Tmatrix6[5] = [0, 0, 0, 0, 0, 1]

                # Store local matrices
                Local_element_matrices.append(matrix6.copy())
                Transformation_matrices.append(Tmatrix6.copy())
            # Calculate global element matrix
            global_element_matrix = np.matrix.transpose(Transformation_matrices[i]).dot(Local_element_matrices[i]).dot(
                Transformation_matrices[i])
            # Store global element matrix
            Global_element_matrices.append(global_element_matrix)
            # Add global element matrix to global stiffness matrix (ss)
            ss[np.ix_(self.INDEX[i], self.INDEX[i])] += global_element_matrix

        # Fixed support conditions
        for i in self.list_nn:
            support = self.support[i][:self.dofs_per_node[i]]
            SUPPORT.append(support)
        support_condition_per_dof = np.concatenate(SUPPORT)

        # Set forces back to starting values
        self.nodal_forces = self.applied_forces.copy()  # prevent adding the gravity/prestress of previous iteration to this iteration

        # Set prestress to 0
        F_prestress = np.zeros_like(self.nodal_forces).flatten()

        # add prestress to the structure
        if PS:  # Check if the element is a beam element
            Center_of_Gravity = np.sum(self.center * x * Length) / np.sum(x * Length)
            for i in Prestress_members:
                if self.dofs[i] == 3:
                    Psmoment = self.PSforce * np.cos(self.Angle[i]) * (Center_of_Gravity - self.center[i])  # Px*e
                    Psvector = np.array(
                        [self.PSforce, 0, -Psmoment, -self.PSforce, 0, Psmoment])  # -ps MOMENT ,PS MOMENT
                else:
                    Psvector = np.array([self.PSforce, 0, -self.PSforce, 0])
                Psvector_global = np.matrix.transpose(Transformation_matrices[i]).dot(Psvector)
                F_prestress[np.ix_(self.INDEX[i])] += Psvector_global

        # Adds Distributed load to the end nodes of an element
        eq_load_ele = np.zeros([self.ne, 6])
        if ForceDL != 0:
            for i in LoadMember:
                l: float = Length[i]
                Q: float = self.distributed_load[i, 0]
                eq_load_ele[i, 1] = -Q * l / 2
                eq_load_ele[i, 4] = -Q * l / 2
                if math.pi / 2 < self.Angle[i] < math.pi * 3 / 2:
                    eq_load_ele[i, 2] = Q * l ** 2 / 12
                    eq_load_ele[i, 5] = -Q * l ** 2 / 12
                else:
                    eq_load_ele[i, 2] = -Q * l ** 2 / 12
                    eq_load_ele[i, 5] = Q * l ** 2 / 12
                self.nodal_forces[self.bars[i, 0], :] += eq_load_ele[i, :len(self.AUX[self.bars[i, 0]])]
                self.nodal_forces[self.bars[i, 1], :] += eq_load_ele[i, 3:3 + len(self.AUX[self.bars[i, 1]])]

        # Adds nodal gravity to the structure
        if gravity:
            for i in self.list_ne:
                P = (-9.801 * density) * (
                            self.section[i] / 1000000)  # Density*volume*9.81 * angle to split into Px and Py
                S = round(math.sin(self.Angle[i]), 5)
                Py = P * S
                Gv1 = (Py * 0.5 * Length[i]) / (S * 1000) if S != 0 else 0
                Gv2 = abs(Py - Gv1) * -1
                if self.Angle[i] < math.pi:
                    self.nodal_forces[self.bars[i, 0], 1] += Gv2
                    self.nodal_forces[self.bars[i, 1], 1] += Gv1
                else:
                    self.nodal_forces[self.bars[i, 0], 1] += Gv1
                    self.nodal_forces[self.bars[i, 1], 1] += Gv2

        # Find free dofs and forces
        free_dof = np.nonzero(support_condition_per_dof)[0].flatten()
        Unrestrained_stiffness_matrix = ss[np.ix_(free_dof, free_dof)]
        Total_forces = self.nodal_forces.flatten() + F_prestress  # you can apply a moment force to a non rotating element
        Unconstrained_forces = Total_forces[free_dof]

        # Solve for displacements in various sorts
        Free_Displacements = np.linalg.solve(Unrestrained_stiffness_matrix, Unconstrained_forces)
        Displacements_vector = self.nodaldis.astype(float).flatten()
        Displacements_vector[free_dof] = Free_Displacements
        Nodal_displacements_matrix = Displacements_vector.reshape(self.nn, self.dofs[0])  # change self.dofs
        self.nodaldis = Nodal_displacements_matrix
        Element_displacement_matrix = np.concatenate(
            (Nodal_displacements_matrix[self.bars[:, 0]], Nodal_displacements_matrix[self.bars[:, 1]]), axis=1)

        # Determine the reaction forces
        self.nodal_force_global = ss.dot(Displacements_vector).reshape(self.nn, self.dofs[0])
        self.reaction_forces = self.nodal_force_global[SupportPoints]

        # Using the displacements solve for forces
        for i in self.list_ne:
            self.local_displacement[i, self.index_dofs[i]] = np.dot(Transformation_matrices[i],
                                                                    Element_displacement_matrix[i])
            self.local_forces[i, self.index_dofs[i]] = Local_element_matrices[i].dot(
                self.local_displacement[i, self.index_dofs[i]])
            # calculate the stresses
            self.stress[i, self.index_dofs[i]] = self.local_forces[i, self.index_dofs[i]] / self.resistance[
                i, self.index_dofs[i]]
            # calculate if an element is in tension or compression
            self.tension[i] = -1 if self.stress[i, 0] > 0 else 1
            # calculate the strain energy per element
            self.strain_energy[i] = np.sum(abs(self.stress[i, self.index_dofs[i]]) ** 2 * (
                        self.Length[i] * self.resistance[i, self.index_dofs[i]]) / 2 * self.young[i])
            # Calculate the stress utilization, depending on the normal force sign
            if self.stress[i, 0] < 0:
                self.MSU[i] = np.mean(abs(self.stress[i, self.index_dofs[i]] / Yieldstress[0, self.index_dofs[i]]))
            else:
                self.MSU[i] = np.mean(abs(self.stress[i, self.index_dofs[i]] / Yieldstress[1, self.index_dofs[i]]))
        return self.strain_energy

    def youngpen(self, x: np.ndarray[float]) -> np.ndarray[float]:
        """
        Adjust the Young's modulus of each bridge element based on stresses in the element

        This method updates the Young's modulus of each element in the bridge structure based on the applied stress and the
        chosen penalization type (Nefs (Linear) or Secant (Smooth)). It calculates the updated Young's modulus to represent either a
        constant ratio of the original Young's modulus (Linear) or a secant modulus based on the Sigmoid stress-strain curve (Smooth).

        :param x: Numpy array containing the sectional heights

        :return: Updated Young's modulus values for each bridge element.
        """
        def F(x, a, b, t, c, s, d):
            """
            distance between a point on Linear curve and Smooth curve
            :param x: x on the curve
            :param a: x of the point location to be optimized towards
            :param b: y of the point location to be optimized towards
            :param t: Yield strength in tension
            :param c: Yield strength in compression
            :param s: Smooth function control variable, calculated in Smooth code
            :param d: Smooth function control variable, calculated in Smooth code

            :return: distance between functions
            """
            return (x - a) ** 2 + (equation(x, t, c, s, d) - b) ** 2

        def deriv_equation(x, t, c, s, d):
            """
            Derivative of sigmoid function
            """
            return s * (c + t) * expit(s * (d + x)) * (1 - expit(s * (d - x)))  # result

        def solve_distance(x, a, b, t, c, s, d):
            """
            Derivative of F, used to guide to optimization.
            """
            return 2 * (x - a) + 2 * (equation(x, t, c, s, d) - b) * deriv_equation(x, t, c, s, d)

        def equation(x, t, c, s, d):
            """
            Standard Sigmoid function with yield stress bounds c,t
            """
            return -t + (c + t) * expit(-1 * s * (x - d))

        # constant | for given material props
        Yield_compression = Yield_C
        Yield_tension = Yield_T
        S = optimized_s
        d = d_result

        # Find corresponding force and strain
        for i in self.list_ne:

            # Linear penalization
            if Penalization == 'Linear':
                if self.tension[i] == 1:
                    self.young[i] = Emin / Nefs_Ratio

            # Smooth penalization
            elif Penalization == 'Smooth':
                # find stresses in elements
                y_stress = self.stress[i, 0]
                # Set bound to stress values
                if y_stress > Yield_compression * 0.99:
                    y_stress = Yield_compression * 0.99
                elif y_stress < -Yield_tension:
                    y_stress = Yield_tension * 0.99

                # estimate strain
                x_strain = y_stress / self.young[i]

                # find strain on the curve given the stress
                x_result = minimize(F, x_strain, args=(x_strain, y_stress, Yield_tension, Yield_compression,
                                                       S, d), jac=solve_distance, method='TNC').x
                # find the stress on the curve given the strain
                y_result = equation(x_result, Yield_tension, Yield_compression, S, d)

                # Derive the youngs modulus as the secant between stress and strain
                self.young[i] = abs(y_result / x_result)
            else:
                self.young = E
        return self.young

    def objective(self, vmax_scale: float, x_percentage: np.ndarray[float], Max_allowable_deflection:float) -> float:
        """
        Objective function to calculate the differnce between the maximum occuring delfection and the maximum allowable deflection

        This method calculates the maximum occurring deflection of the bridge for a given scaling factor vmax_scale of
        the sectional areas. It then computes the difference between the maximum allowable deflection and the maximum
        occurring deflection. The optimization process aims to minimize this difference.

        :param vmax_scale: Scaling factor for the sectional areas
        :param x_percentage: Percentage of the maximum volume each element is allowed to use.
        :param Max_allowable_deflection: Maximum allowable deflection for the bridge.

        :return: The difference between the maximum allowable deflection and the maximum occurring deflection.
        """
        if vmax_scale < 0:
            return 1000  #Return a high value as a penalty for invalid scaling factors
        x = x_percentage * self.vmax * vmax_scale / self.Length
        # run the analysis with the sectional heights to find the deflection
        bridge.analysis(x)
        # derive the calculated deflection
        Max_occuring_deflection = max(max(abs(self.nodaldis[:, 1])), max(abs(self.nodaldis[:, 0])))
        return Max_allowable_deflection - Max_occuring_deflection # desired to be 0

    def find_vmax(self, x_percentage: np.ndarray[float], vmax: float, Max_allowable_deflection: float) -> float:
        """
        Finds the optimal scaling factor vmax_scale to minimize deflection.

        This method performs an optimization process to find the optimal scaling factor vmax_scale for the element sectional
        areas that minimizes, preferably roots, the difference between the maximum allowable deflection and the maximum occurring deflection of the
        bridge.

        :param vmax_scale: Scaling factor for the sectional areas
        :param x_percentage: Percentage of the maximum volume each element is allowed to use.
        :param Max_allowable_deflection: Maximum allowable deflection for the bridge.

        :return: The optimal maximum volume scaling factor
            """
        vmax_scale = 1 # Initial scaling factor
        vmax_init = vmax_scale
        result = root(self.objective, x0=vmax_init, args=(x_percentage, Max_allowable_deflection), method='hybr')
        return result.x # Return the optimal scaling factor

    def forced_members(self, StrainEi: np.ndarray[float], StrainE:float) -> np.ndarray[float]:
        """
        Set a minium sectional height to desired elements by fictively boosting their strain energy.

        This method adjusts the strain energy of specific bridge elements to reach a certain amount of minimum printlayers.
        This, while keeping the overall strain energy of the bridge the same.

        :param StrainEi: Numpy array representing the strain energy of each bridge element.
        :param StrainE: Total strain energy in the system

        :return: Numpy array of the adjusted strain energy values.
        """
        # initalize variable
        E_delta = 0

        # run over the elements
        for i in self.list_ne:
            # continue for CC members
            if i in Non_zero_members:
                # Calculate the strain energy threshold
                E_threshold = ManuP * StrainE * Length[i] / self.vmax
                # if below the threshold update it to the threshhold
                if StrainEi[i] < E_threshold:
                    E_delta += E_threshold - StrainEi[i]
                    StrainEi[i] = E_threshold
        # calculate the reduction factor to retain energy in the system
        E_scalar = ((StrainE - E_delta) / StrainE)

        # apply reduces strain energy for all non CC members based on E_scalar
        for i in self.list_ne:
            if i not in Non_zero_members:
                StrainEi[i] = StrainEi[i] * E_scalar
        return StrainEi

    def optimize_x(self, x:np.ndarray[float]) -> np.ndarray[float]:
        """
        Optimize the dimensions of bridge elements to meet strain energy and material constraints.

        This method iteratively optimizes the dimensions (sectional height) of bridge elements to achieve a target strain energy
            while considering material constraints and convergence criteria. The optimization process may also adjust the scaling factor
            for element lengths (`vmax_scale`) if `Optimize_vmax` is enabled.

            Parameters:
            - x: Numpy array representing the initial dimensions (sectional heights) of bridge elements.

            Returns:
            - Numpy array: Optimized dimensions (sectional heights) of bridge elements.
        """
        # initialize later used variables
        iteration = 0
        x_new, x_damped = np.zeros(self.ne), np.zeros(self.ne)
        converged = False

        # Strain Energy optimization!
        while iteration != Max_iterations and not converged:
            # Do analysis
            self.analysis(x)

            # Update youngs modulus
            if Youngpen:
                self.youngpen(x)

            # retrieve strain energy
            StrainEi = self.strain_energy  # rotation = factor 3 higher than strainE therefore only contributing
            StrainE = np.sum(StrainEi)

            # Apply CC
            if Forced_member_sizes:
                StrainEi = self.forced_members(StrainEi, StrainE)

            # update strain energy and store
            StrainE = np.sum(StrainEi)
            self.Epoch.append(StrainE)

            # Calculate New section areas based on strain Energy!
            x_percentage = (StrainEi / StrainE)
            x_new = (x_percentage * self.vmax) / Length  # b taken out constant for all members

            #check if the structure converged
            if converging and iteration > 1:
                # convergence stopping criterea
                if abs(self.Epoch[iteration] - self.Epoch[iteration - 1]) < conv_tolerance_rate * self.Epoch[iteration]:
                    print('converged in {} iterations'.format(iteration))
                    converged = True

                # calculate the damped version of x
                x_damped = x + ((x_new - x) * (1 - damp_factor))  # add or remove /x[i]
                    #if x_damped[i] < x_threshold:
                    #    x_damped[i] = x_threshold
                x = x_damped
            else:
                x = x_new
            # x values below the threshold are updated to the threshhold
            x[x <= x_threshold] = x_threshold
            iteration += 1

        # Vmax optimization!
        vmax_scale = 1  # reference vmax_Scale so that it does not error when Optimizevmax = false
        if Optimize_vmax:

            # set youngs modulus back to normal properties
            self.young = E

            # find vmax_scale so that maximum allowable deflection = maximum occuring deflection
            self.vmax_scale = self.find_vmax(x_percentage, self.vmax, Max_allowable_deflection)[0]

            # update the sectional heights with vmax scale
            x_vmax = x * self.vmax_scale

            # Make sure CC member still have their desired minimum height
            if Forced_member_sizes:
                for i in Non_zero_members:
                    if x_vmax[i] < ManuP:
                        x_vmax[i] = ManuP
            x = x_vmax
        # Do final analysis with last value of x
        bridge.analysis(x)

        # Remove all members below the threshold values
        x[x <= x_threshold * self.vmax_scale] = 0
        return x


# Element connectivity
conv_tolerance_rate = 1e-3
E = np.array(init_young)
x = np.array(init_height)
b = np.array(b)
Prestress_members = np.array(PSmembers)
nodes = np.array([[xc[index], y[index]] for index, _ in enumerate(y)], dtype="f")
bars = np.array([[Bn1[index], Bn2[index]] for index, _ in enumerate(Bn1)])
Non_zero_members2 = np.array(Non_zero_members)
Length = np.array(Length2, dtype="f")
Emin = E[0]
Angle = np.array(Angles, dtype='f')

# Create beam object
bridge = Bridge(E, b, nodes, bars, DOFs, Length, Angle, x)

# forces and boundary conditions
distributed_load_1 = bridge.distributed_load
distributed_load_1[LoadMember] = np.array([ForceDL * 1000])
nodal_force_1 = bridge.applied_forces
if bridge.dofs[Loadnode] == 2:
    nodal_force_1[Loadnode] = (Forcevector[0] * 1000, Forcevector[1] * 1000)
elif bridge.dofs[Loadnode] == 3:
    nodal_force_1[Loadnode] = (Forcevector[0] * 1000, Forcevector[1] * 1000, 0)

# Assign support conditions
support_1 = bridge.support
support_1[SupportPoints[0], (0, 1)] = 0
support_1[SupportPoints[1], 1] = 0

# Calculate yield stress vectors.
Yield_compression = 30
Yield_tension = 3
Yield_shear = 0.1 * math.sqrt(Yield_compression)
flexure_strength = 0.7 * math.sqrt(Yield_compression)
Yieldstress = np.array(
    [[Yield_compression, Yield_shear, flexure_strength, Yield_compression, Yield_shear, flexure_strength],
     [Yield_tension, Yield_shear, flexure_strength, Yield_tension, Yield_shear, flexure_strength]])

# Perform analysis
bridge.analysis(x)

# Perform optimization
Heights = bridge.optimize_x(x)

# Retrieve desired output from bridge class
TC = bridge.tension
Epoch = np.array(bridge.Epoch)
Max_def = np.max(abs(bridge.nodaldis[:, 1]))
Mean_dis = np.mean(bridge.nodaldis)
SF_v = sum(abs(bridge.reaction_forces[:, 1]))
SF_h = sum(abs(bridge.reaction_forces[:, 0]))
Vmax_scale = bridge.vmax_scale
Vmax = sum(Heights * Length * b)
MPU = np.mean(Heights / printwidth)
MSU = np.mean(bridge.MSU.astype(float))
Forces = bridge.local_forces[:, 0]
# ---------- end rc_2 ----------
# ---- group: Control data gathering (continued)
amount_of_possible_solutions = Panel(generative_design_2.length)

# ---- group: check convergence of bridge
maximum_allowable_displacement_2 = Panel(cluster_3)
vmax_scale_2 = Panel(rc_2.Vmax_scale)
maximum_occuring_displacement_2 = Panel(rc_2.Max_def)

# ---- group: visualization
ghpython_script = GhPythonScript(x=rc_2.Heights)  # -> out, numbers
# ---------- ghpython_script: Python ----------
import rhinoscriptsyntax as rs
import re

string = x
numbers = []
numeric_substrings = re.findall(r'-?\d+\.?\d*(?:e[+-]?\d+)?', string)
for substring in numeric_substrings:
    numbers.append(float(substring))

print(numbers)
# ---------- end ghpython_script ----------
ghpython_script_2 = GhPythonScript(x=rc_2.TC)  # -> out, numbers
# ---------- ghpython_script_2: Python ----------
import rhinoscriptsyntax as rs
import re

string = x
numbers = []
numeric_substrings = re.findall(r'-?\d+\.?\d*(?:e[+-]?\d+)?', string)
for substring in numeric_substrings:
    numbers.append(float(substring))
print(numbers)
# ---------- end ghpython_script_2 ----------
construct_point = ConstructPoint(XCoordinate=4, YCoordinate=4, ZCoordinate=0)
cluster_5 = Cluster_2(line=cluster_4.lines, value=ghpython_script.numbers, list=ghpython_script_2.numbers)  # -> flatten(pipe_2), list_a, list_b
text_tag = TextTag(Location=construct_point, Text="Generative bridge", Colour=RGB(0, 0, 0))
# nonzero member
# Loads
# set max deflection and check other constants
# do iteration without youngpen
# add manuP to init_Values
# check PS +DIRECTION
# check tension/compression directions
# nonzero member
# PSmembers
custom_preview = CustomPreview(Geometry=cluster_5.pipe_2, Material=ColourSwatch(SwatchColor=RGBA(209, 209, 209, 53)))
custom_preview_2 = CustomPreview(Geometry=cluster_5.list_a, Material=ColourSwatch(SwatchColor=RGB(8, 0, 255)))
custom_preview_3 = CustomPreview(Geometry=cluster_5.list_b, Material=ColourSwatch(SwatchColor=RGB(255, 0, 0)))

vector_xyz = VectorXYZ(XComponent=15, YComponent=0, ZComponent=0)  # -> Vector, Length
ghpython_script_3 = GhPythonScript(x=rc.Heights)  # -> out, numbers; same code as ghpython_script
ghpython_script_4 = GhPythonScript(x=rc.TC)  # -> out, numbers; same code as ghpython_script_2
cluster_6 = Cluster_8(line=cluster_2.lines, value=ghpython_script_3.numbers, list=ghpython_script_4.numbers, motion=vector_xyz.Vector)  # -> flatten(geometry_3), geometry, geometry_2
move = Move(Geometry=construct_point, Motion=vector_xyz.Vector)  # -> Geometry, Transform
custom_preview_4 = CustomPreview(Geometry=cluster_6.geometry, Material=ColourSwatch(SwatchColor=RGB(8, 0, 255)))
custom_preview_5 = CustomPreview(Geometry=cluster_6.geometry_2, Material=ColourSwatch(SwatchColor=RGB(255, 0, 0)))
custom_preview_6 = CustomPreview(Geometry=cluster_6.geometry_3, Material=ColourSwatch(SwatchColor=RGBA(0, 0, 0, 53)))
text_tag_2 = TextTag(Location=move.Geometry, Text="Manual bridge", Colour=RGB(0, 0, 0))

# ----
concatenate = Concatenate(
    dampfactor="Dampfactor = ",
    A=damp_factor_2,
    max_iterations=",max_iterations =",
    B=max_iterations_2,
    init_b=", init_b = ",
    C=fixed_width_mm_2,
    init_h=", init_h = ",
    D=initial_height_mm_2,
    E=distance_between_vertical_points_2)
headers_input_data = Panel("""nodes
ctc
domain_1
domain_2
domain_3
youngPen
a_p
manu_type
ManuP
L_ManuP""")
cluster_7 = Cluster(_0_0=cluster_4.i, _0_1=cluster_4.item_1, _0_0_2=cluster_4.x_component, _0_1_2=cluster_4.y_component_2)  # -> ctc, nodes
list_item_2 = ListItem(List=generative_design_2.result, Index=0, Wrap=True)  # -> Item, Item1, Item2
script_3 = Script(
    Column_names=headers_input_data,
    init_values=concatenate,
    nodes=cluster_7.nodes,
    ctc=cluster_7.ctc,
    domain1=list_item_2.Item,
    domain2=list_item_2.Item1,
    domain3=list_item_2.Item2,
    youngpen=generative_design_2.i,
    prestress=generative_design_2.result_2,
    manu_type=generative_design_2.i_3,
    ManuP=[printlayer_width, n_printlayers_for_cc_2],
    L_ManuP=generative_design_2.i_2,
    enable=enable_storage,
    reset=reset_storage,
    write_pandas=write_pandas_df,
    filepath=panel_2)  # -> out; inputs Column_names: list of String, init_values: String, domain1: Double, domain2: Double, domain3: Double, youngpen: String, prestress: Double, manu_type: String, ManuP: list of Int32, enable: Boolean, reset: Boolean, filepath: String
# ---------- script_3: Python ----------
import pandas as pd 
import scriptcontext as sc

def object_to_numbers(x):
    """
    Converts the numpy array objects to a list of individual elements.

    :param x: numpy array object to be converted.

    :return: List containing individual elements from the input.
    """
    x_list = []
    for i in range(len(x)):
        x_list.append(x[i])
    return x_list

def data_recorder(var_name:str , x_list, reset:bool, enable:bool):
    """
    Records data throughout slider iterations
    
    :param var_name: Name of the variable.
    :param x_list: List of data to be recorded.
    :param reset: If True, reset the recorded data.
    :param enable: If True, enable recording.

    :return: Recorded data for the variable.
    """
    if reset or var_name not in sc.sticky:
        sc.sticky[var_name] = []
    rec = sc.sticky[var_name]
    if enable == True:
        rec.append(x_list)
    return rec

# Define the list of variables you want to record
recorded_data = {}
variable = []
variables = [nodes, ctc, domain1,domain2,domain3,youngpen,prestress,manu_type, ManuP,L_ManuP]

# Convert selected variables to lists of numbers
variable = variables
variable[0] = object_to_numbers(variables[0]) 
variable[1] = object_to_numbers(variables[1]) 
print(len(recorded_data))


if reset ==True:
    recorded_data[Column_names] = []

# Iterate over the column names and record the data
for i, var_name in enumerate(Column_names):
    recorded_data[var_name] = data_recorder(var_name, variable[i], reset, enable)

# Write the recorded list into a JSON file
if write_pandas == True:
    df = pd.DataFrame.from_dict(recorded_data, orient='index').T
    df.attrs['caption'] = init_values
    print(df.shape)
    df.to_json(filepath, orient= 'records',lines =True)
# ---------- end script_3 ----------

# ---- group: storing output data
headers_output_data = Panel("""Forces
Heights
MSU
MPU
Vmax_scale
Vmax 
Epoch
SF_v
SF_h
Max_def
Mean_def""")
script_4 = Script(
    Column_names=headers_output_data,
    Forces=rc_2.Forces,
    Heights=rc_2.Heights,
    Epoch=rc_2.Epoch,
    MSU=rc_2.MSU,
    MPU=rc_2.MPU,
    SF_v=rc_2.SF_v,
    SF_h=rc_2.SF_h,
    Vmax_scale=rc_2.Vmax_scale,
    Vmax=rc_2.Vmax,
    Max_def=rc_2.Max_def,
    Mean_def=rc_2.Mean_dis,
    enable=enable_storage,
    reset=reset_storage,
    write_pandas=write_pandas_df,
    filepath=panel)  # -> out; inputs Column_names: list of String, MSU: Double, MPU: Double, Vmax_scale: Double, enable: Boolean, reset: Boolean, filepath: String
# ---------- script_4: Python ----------
import locale 
locale.setlocale(locale.LC_ALL, 'en_US')

import pandas as pd 
import scriptcontext as sc
import json
from typing import List

def object_to_numbers(x):
    """
    Converts the numpy array objects to a list of individual elements.

    :param x: numpy array object to be converted.

    :return: List containing individual elements from the input.
    """
    x_list = []
    for i in range(len(x)):
        x_list.append(x[i])
    return x_list

def data_recorder(var_name:str , x_list:List, reset:bool, enable:bool):
    """
    Records data throughout slider iterations
    
    :param var_name: Name of the variable.
    :param x_list: List of data to be recorded.
    :param reset: If True, reset the recorded data.
    :param enable: If True, enable recording.

    :return: Recorded data for the variable.
    """
    if reset or var_name not in sc.sticky:
        sc.sticky[var_name] = []
    rec = sc.sticky[var_name]
    if enable == True:
        rec.append(x_list)
    return rec

# Define the list of variables you want to record
recorded_data = {}
variable = []
variable = [Forces,Heights, MSU,MPU,Vmax_scale,Vmax,Epoch,SF_v,SF_h,Max_def,Mean_def] 

vari = [MSU,MPU,Vmax_scale,Vmax,Max_def,Mean_def]

# Convert selected variables to lists of numbers
variable[0] = object_to_numbers(variable[0])
variable[1] = object_to_numbers(variable[1])
variable[6] = object_to_numbers(variable[6])

if reset ==True:
    recorded_data[Column_names] = []

# Iterate over the column names and record the data
for i, var_name in enumerate(Column_names):
    recorded_data[var_name] = data_recorder(var_name, variable[i], reset, enable)

# Write the recorded list into a JSON file
if write_pandas:
    print('hi')
    df = pd.DataFrame.from_dict(recorded_data, orient='index').T
    print(df.shape)
    df.to_json(filepath, orient= 'records',lines =True)
# ---------- end script_4 ----------

# ==== cluster Cluster
_0_0 = ClusterInput()
_0_1 = ClusterInput()
_0_0_2 = ClusterInput()
_0_1_2 = ClusterInput()
entwine = Entwine(Branch00=_0_0, Branch01=_0_1, FlattenInputs=True)
entwine_2 = Entwine(Branch00=_0_0_2, Branch01=_0_1_2, FlattenInputs=True)
explode_tree = ExplodeTree(Data=entwine)  # -> Branch0, Branch1
explode_tree_2 = ExplodeTree(Data=entwine_2)  # -> Branch0, Branch1
script = Script(x=explode_tree.Branch0, y=explode_tree.Branch1, z=explode_tree_2.Branch0, u=explode_tree_2.Branch1)  # -> out, ctc, nodes; inputs x: list of Int32, y: list of Int32, z: list of Double, u: list of Double
# ---------- script: Python ----------
import numpy as np
ctc =np.array([x,y])
nodes = []
nodes = np.array([z,u])
# ---------- end script ----------
ctc = ClusterOutput(script.ctc)
nodes = ClusterOutput(script.nodes)

# ==== cluster Cluster_2

# ---- group: Tension or compression
list = ClusterInput()

# ---- group: Heights
value = ClusterInput()

# ---- group: all lines
line = ClusterInput()

# ---- group: Create volumes for visualization
absolute = Absolute(Value=value)
division = Division(A=simplify(1), B=100)
division_2 = Division(A=absolute, B=1000)
line_2 = Line(line)
expression = Expression(x=division_2, b=division, Expression="if(x=0,0,b)")
construct_domain = ConstructDomain(DomainStart=expr("-x", division_2), DomainEnd=division_2)
perp_frame = PerpFrame(Curve=line_2, Parameter=0)
equality = Equality(FirstNumber=expression, SecondNumber=0)  # -> Equality, Inequality
rectangle = Rectangle(Plane=perp_frame, XSize=expression, YSize=construct_domain, Radius=0)  # -> Rectangle, Length
dispatch = Dispatch(List=list, DispatchPattern=equality.Equality)  # -> ListA, ListB
sweep1 = Sweep1(Rail=graft(line_2), Sections=graft(rectangle.Rectangle), Miter=1)  # -> flatten(Brep)
dispatch_2 = Dispatch(List=sweep1, DispatchPattern=equality.Equality)  # -> ListA, ListB
equality_2 = Equality(FirstNumber=dispatch.ListB, SecondNumber=1)  # -> Equality, Inequality
dispatch_3 = Dispatch(List=line_2, DispatchPattern=equality.Equality)  # -> ListA, ListB
pipe = Pipe(Curve=dispatch_3.ListA, Radius=0.01, Caps=0)
dispatch_4 = Dispatch(List=dispatch_2.ListB, DispatchPattern=equality_2.Equality)  # -> ListA, ListB

# ---- group: Brep in tension
list_a = ClusterOutput(dispatch_4.ListA)

# ---- group: Brep in compression
list_b = ClusterOutput(dispatch_4.ListB)

# ---- group: 'removed' elements
pipe_2 = ClusterOutput(pipe)

# ==== cluster GenerativeDesign

# ---- group: amount of options
value = ClusterInput()

# ---- group: stepsize in y direction
step = ClusterInput()

# ---- group: other generative options
beam_truss = ClusterInput()
youngpen = ClusterInput()
prestress = ClusterInput()
printlayers = ClusterInput()

# ----
index = ClusterInput()

# ---- group: Setup generative design
negative = Negative(Value=value)
multiplication = Multiplication(A=negative, B=step)
multiplication_2 = Multiplication(A=multiplication, B=2)
division = Division(A=multiplication_2, B=step)
series = Series(Start=multiplication, Step=expr("abs(x)", step), Count=expr("abs(x)+1", division))
division_2 = Division(A=division, B=2)
cull_index = CullIndex(List=series, Indices=expr("x-1", division_2), Wrap=True)

# ---- group: Setup generative design / Create all possible combinations
cross_reference = CrossReference(
    ListDomain1=cull_index,
    ListDomain2=cull_index,
    ListDomain3=cull_index,
    ListYoungpen=youngpen,
    ListPrestress=prestress,
    ListPrintlayers=printlayers,
    ListBeamTruss=beam_truss,
    CrossMode=1)  # -> ListDomain1, ListDomain2, ListDomain3, ListYoungpen, ListPrestress, ListPrintlayers, ListBeamTruss

# ---- group: Setup generative design (continued)
list_item = ListItem(List=cross_reference.ListDomain1, Index=index, Wrap=True)
list_item_2 = ListItem(List=cross_reference.ListDomain2, Index=index, Wrap=True)
list_item_3 = ListItem(List=cross_reference.ListDomain3, Index=index, Wrap=True)
list_item_4 = ListItem(List=cross_reference.ListYoungpen, Index=index, Wrap=True)
list_item_5 = ListItem(List=cross_reference.ListPrestress, Index=index, Wrap=True)
list_item_6 = ListItem(List=cross_reference.ListPrintlayers, Index=index, Wrap=True)
list_item_7 = ListItem(List=cross_reference.ListBeamTruss, Index=index, Wrap=True)
entwine = Entwine(Branch00=list_item, Branch01=list_item_2, Branch02=list_item_3, FlattenInputs=True)  # -> flatten(Result)
expression = Expression(r=list_item_5, Expression="π*r^2 ")

list_length = ListLength(List=cross_reference.ListDomain1)

# ----
i = ClusterOutput(list_item_4)
i_2 = ClusterOutput(list_item_6)
i_3 = ClusterOutput(list_item_7)
length = ClusterOutput(list_length)
result = ClusterOutput(entwine)
result_2 = ClusterOutput(expression)

# ==== cluster Cluster_6
y_component = ClusterInput()

# ---- group: Amount of control points
number = ClusterInput()

# ----
number_2 = ClusterInput()

# ---- group: create half bounding box
number_3 = Number(number_2)
number_4 = Number(number)
series = Series(Start=0, Step=number_3, Count=number_4)
vector_xyz = VectorXYZ(XComponent=0, YComponent=y_component, ZComponent=0)  # -> Vector, Length
construct_point = ConstructPoint(XCoordinate=series, YCoordinate=0, ZCoordinate=0)
move = Move(Geometry=construct_point, Motion=vector_xyz.Vector)  # -> Geometry, Transform
deconstruct = Deconstruct(Point=construct_point)  # -> XComponent, YComponent, ZComponent
deconstruct_2 = Deconstruct(Point=move.Geometry)  # -> XComponent, YComponent, ZComponent
entwine = Entwine(Branch00=construct_point, Branch01=move.Geometry, FlattenInputs=True)
merge = Merge(Data1=graft(deconstruct.YComponent), Data2=graft(deconstruct_2.YComponent))
flip_matrix = FlipMatrix(Data=entwine)
sort_list = SortList(Keys=merge, ValuesValuesA=flip_matrix)  # -> Keys, ValuesValuesA
list_item = ListItem(List=sort_list.ValuesValuesA, Index=-1, Wrap=True)
list_item_2 = ListItem(List=sort_list.ValuesValuesA, Index=0, Wrap=True)
polyline = PolyLine(Vertices=flatten(list_item_2), Closed=False)
polyline_2 = PolyLine(Vertices=flatten(list_item), Closed=False)
end_points = EndPoints(Curve=polyline_2)  # -> Start, End
end_points_2 = EndPoints(Curve=polyline)  # -> Start, End
relay = Relay([polyline, polyline_2])
line = Line(StartPoint=end_points.Start, EndPoint=end_points_2.Start)
line_2 = Line(StartPoint=end_points.End, EndPoint=end_points_2.End)
join_curves = JoinCurves(Curves=[line, line_2, polyline_2, polyline], Preserve=False)

# ---- group: Subdivision
number_5 = ClusterInput()

# ---- group: create subdivision within bounding box
number_6 = Number(number_5)
division = Division(A=1, B=number_6)
series_2 = Series(Start=division, Step=division, Count=expr("x-1", number_6))
clean_tree = CleanTree(RemoveNulls=True, RemoveInvalid=True, RemoveEmpty=False, Tree=series_2)
entwine_2 = Entwine(Branch00=flatten(list_item), Branch01=flatten(list_item_2), FlattenInputs=True)
tween_consecutive_points = TweenConsecutivePoints(Points=entwine_2, Factor=clean_tree, Weighted=False, Loopback=False, Degree=3, InterpolationType=0)
merge_2 = Merge(Data1=simplify(entwine_2), Data2=simplify(tween_consecutive_points))
flip_matrix_2 = FlipMatrix(Data=merge_2)
tween_consecutive_points_2 = TweenConsecutivePoints(Points=flip_matrix_2, Factor=clean_tree, Weighted=False, Loopback=False, Degree=3, InterpolationType=0)

# ---- group: Subdivisiontype
gate = ClusterInput()

# ---- group: generate crossrefernced model
stream_filter = StreamFilter(Gate=gate, Stream1=merge_2)
stream_filter_2 = StreamFilter(Gate=gate, Stream1=tween_consecutive_points_2)
stream_filter_3 = StreamFilter(Gate=gate, Stream1=list_item)
stream_filter_4 = StreamFilter(Gate=gate, Stream1=list_item_2)
cross_reference = CrossReference(
    ListB=flatten(stream_filter_3),
    ListA=flatten(stream_filter_4),
    ListListA=flatten(stream_filter),
    ListListB=flatten(stream_filter_2),
    CrossMode=1)  # -> ListB, ListA, ListListA, ListListB
line_3 = Line(StartPoint=cross_reference.ListListA, EndPoint=cross_reference.ListListB)
line_4 = Line(StartPoint=cross_reference.ListB, EndPoint=cross_reference.ListA)
merge_3 = Merge(Data1=line_4, Data2=line_3)
split_with_brep = SplitWithBrep(Curve=merge_3, Brep=join_curves)  # -> Curve, Points
list_length = ListLength(List=split_with_brep.Curve)
member_index = MemberIndex(Set=flatten(list_length), Member=1)  # -> Index, Count
tree_statistics = TreeStatistics(Tree=split_with_brep.Curve)  # -> Paths, Length, Count
list_item_3 = ListItem(List=tree_statistics.Paths, Index=member_index.Index, Wrap=True)
tree_branch = TreeBranch(Tree=split_with_brep.Curve, Path=list_item_3, MaintainPaths=True)
merge_4 = Merge(Data1=relay, Data2=tree_branch)  # -> flatten(Result)

# ---- group: Create structured grid
cluster = Cluster_5(_0_x=merge_2, data=tween_consecutive_points_2)
sort_points = SortPoints(Points=cluster)  # -> Points, Indices
graft_tree = GraftTree(Tree=sort_points.Points, IncludeEmptyLists=True, IncludeNullItems=True)  # -> simplify(Tree)
flip_matrix_3 = FlipMatrix(Data=sort_points.Points)
relative_item = RelativeItem(Tree=graft_tree, Offset="{-1;1}", WrapPaths=False, WrapItems=False)  # -> ItemA, ItemB
relative_item_2 = RelativeItem(Tree=graft_tree, Offset="{1;1}", WrapPaths=False, WrapItems=False)  # -> ItemA, ItemB
interpolate = Interpolate(Vertices=flip_matrix_3, Degree=1, Periodic=False, KnotStyle=1)  # -> Curve, Length, Domain
interpolate_2 = Interpolate(Vertices=sort_points.Points, Degree=1, Periodic=False, KnotStyle=1)  # -> Curve, Length, Domain
line_5 = Line(StartPoint=relative_item_2.ItemA, EndPoint=relative_item_2.ItemB)
line_6 = Line(StartPoint=relative_item.ItemA, EndPoint=relative_item.ItemB)
merge_5 = Merge(Data1=interpolate.Curve, Data2=interpolate_2.Curve, Data3=line_6, Data4=line_5)  # -> flatten(Result)

# ---- group: SPAN OF THE BRIDGE
expression = Expression(Dx=number_3, n=number_4, Expression="Dx*(n-1)*2")
unit_x = UnitX(Factor=expression)
list_item_4 = ListItem(List=construct_point, Index=0, Wrap=True)
move_2 = Move(Geometry=list_item_4, Motion=unit_x)  # -> Geometry, Transform
line_7 = Line(StartPoint=move_2.Geometry, EndPoint=list_item_4)

# ---- group: GENERATE ENTIRE STRUCTURE
list_item_5 = ListItem(List=construct_point, Index=-1, Wrap=True)
stream_filter_5 = StreamFilter(Gate=gate, Stream0=merge_5, Stream1=merge_4)
yz_plane = YZPlane(Origin=list_item_5)
mirror = Mirror(Geometry=join_curves, Plane=yz_plane)  # -> Geometry, Transform
mirror_2 = Mirror(Geometry=stream_filter_5, Plane=yz_plane)  # -> Geometry, Transform
merge_6 = Merge(Data1=stream_filter_5, Data2=line_7, Data3=mirror_2.Geometry)  # -> flatten(Result)
explode = Explode(Curve=merge_6, Recursive=True)  # -> flatten(Segments), Vertices
network_from_lines = NetworkFromLines(Lines=explode.Segments, Tolerance=0.1)  # -> PointPointTopology, ConnectionPointTopology, Points, Lines

# ----
lines = ClusterOutput(network_from_lines.Lines)

# ---- group: Desired construction constraint
x = ClusterInput()

# ---- group: FIND THE DESIRED CONSTRAINT MEMBERS
explode_2 = Explode(Curve=[mirror.Geometry, join_curves], Recursive=True)  # -> Segments, Vertices
curve_middle = CurveMiddle(Curve=line_7)
curve_middle_2 = CurveMiddle(Curve=explode_2.Segments)
deconstruct_3 = Deconstruct(Point=curve_middle_2)  # -> XComponent, YComponent, ZComponent
deconstruct_4 = Deconstruct(Point=curve_middle)  # -> XComponent, YComponent, ZComponent
removeduplicatelines = RemoveDuplicateLines(Lines=network_from_lines.Lines, Tolerance=0.01)
larger_than = LargerThan(FirstNumber=deconstruct_3.XComponent, SecondNumber=0)  # -> LargerThan, OrEqualTo
equality = Equality(FirstNumber=deconstruct_3.XComponent, SecondNumber=deconstruct_4.XComponent)  # -> Equality, Inequality
curve_middle_3 = CurveMiddle(Curve=removeduplicatelines)
gate_and = GateAnd(A=larger_than.LargerThan, B=equality.Equality)
point_plane_side = PointPlaneSide(Point=curve_middle_3, Plane=yz_plane)  # -> Side, Front, Back, Distance
collision_one_many = CollisionOneMany(Collider=curve_middle_3, Obstacles=line_7)  # -> Collision, Index
dispatch = Dispatch(List=explode_2.Segments, DispatchPattern=gate_and)  # -> ListA, flatten(ListB)
equality_2 = Equality(FirstNumber=point_plane_side.Distance, SecondNumber=0)  # -> Equality, Inequality
member_index_2 = MemberIndex(Set=collision_one_many.Collision, Member=True)  # -> Index, Count
collision_one_many_2 = CollisionOneMany(Collider=curve_middle_3, Obstacles=dispatch.ListB)  # -> Collision, Index
dispatch_2 = Dispatch(List=removeduplicatelines, DispatchPattern=equality_2.Equality)  # -> ListA, ListB
member_index_3 = MemberIndex(Set=collision_one_many_2.Collision, Member=True)  # -> Index, Count
member_index_4 = MemberIndex(Set=equality_2.Equality, Member=True)  # -> Index, Count
boolean_toggle = BooleanToggle(True)
expression_2 = Expression(x=x, Expression="if(x =\"Ledge\",3,if(x=\"Loadpath\",1,if(x=\"Lmid\",2,0)))")
merge_7 = Merge(Data1=boolean_toggle, Data2=flatten(member_index_4.Index), Data3=flatten(member_index_2.Index))
merge_8 = Merge(Data1=boolean_toggle, Data2=flatten(member_index_2.Index), Data3=flatten(member_index_3.Index))
create_set = CreateSet(List=merge_7)  # -> Set, Map
create_set_2 = CreateSet(List=merge_8)  # -> Set, Map
stream_filter_6 = StreamFilter(
    Gate=expression_2,
    Stream0=Toggle(False),
    Stream1=flatten([member_index_2.Index, boolean_toggle]),
    Stream2=flatten(create_set.Set),
    Stream3=flatten(create_set_2.Set))

# ---- group: FIND PS MEMBERS
list_item_6 = ListItem(List=flatten(list_item_2), Index=1, Wrap=True)
shift_paths = ShiftPaths(Data=line_6, Offset=-1)
merge_9 = Merge(Data1=list_item_6, Data2=end_points_2.End)
polyline_3 = PolyLine(Vertices=merge_9, Closed=False)
list_item_7 = ListItem(List=shift_paths, Index=graft([2, 1, 0]), Wrap=True)  # -> flatten(Item)
end_points_3 = EndPoints(Curve=line_7)  # -> Start, End
member_index_5 = MemberIndex(Set=[end_points_3.Start, end_points_3.End], Member=end_points_2.Start)  # -> Index, Count
join_curves_2 = JoinCurves(Curves=[polyline_3, list_item_7], Preserve=False)
stream_filter_7 = StreamFilter(Gate=member_index_5.Count, Stream0=join_curves_2, Stream1=polyline)
mirror_3 = Mirror(Geometry=stream_filter_7, Plane=yz_plane)  # -> Geometry, Transform
join_curves_3 = JoinCurves(Curves=[mirror_3.Geometry, stream_filter_7], Preserve=False)
collision_one_many_3 = CollisionOneMany(Collider=curve_middle_3, Obstacles=join_curves_3)  # -> Collision, Index
member_index_6 = MemberIndex(Set=collision_one_many_3.Collision, Member=True)  # -> Index, Count
list_item_8 = ListItem(List=removeduplicatelines, Index=member_index_6.Index, Wrap=True)

# ---- group: indices of PS members
index = ClusterOutput(member_index_6.Index)

# ---- group: visualize PS member
line_8 = Line(list_item_8)

# ---- group: Data that needs to be duplicated for each member
_0_0 = ClusterInput()
_0_1 = ClusterInput()
_0_2 = ClusterInput()

# ---- group: printwidth + amount of paths
A = ClusterInput()
B = ClusterInput()

# ---- group: input pointloads
d1 = ClusterInput()
d2 = ClusterInput()

# ----
line_9 = Line(network_from_lines.Lines)

# ---- group: Calculations before python|data manipulation for python
# optional to set a Pointload
point = Point(network_from_lines.Points)
entwine_3 = Entwine(Branch00=_0_0, Branch01=_0_1, Branch02=_0_2, FlattenInputs=True)
list_length_2 = ListLength(List=line_9)
cluster_2 = Cluster_3(curve=line_7, points=point, curve_2=dispatch_2.ListA, curve_3=line_9)  # -> index, index_3, index_2
duplicate_data = DuplicateData(Data=entwine_3, Number=list_length_2, Order=True)
cluster_3 = Cluster_4(point=point, list=network_from_lines.ConnectionPointTopology, curve_2=line_9, curve=line_9)  # -> x_component, y_component, i, item_1, length_mm, degrees_2
explode_tree = ExplodeTree(Data=duplicate_data)  # -> Branch0, Branch1, Branch2
merge_10 = Merge(Data1=d1, Data2=d2)
multiplication = Multiplication(A=A, B=B)

# ----
_0_2_0 = ClusterOutput(explode_tree.Branch2)
_0_0_0 = ClusterOutput(explode_tree.Branch0)
_0_1_0 = ClusterOutput(explode_tree.Branch1)
manup = ClusterOutput(multiplication)
x_component = ClusterOutput(cluster_3.x_component)
y_component_2 = ClusterOutput(cluster_3.y_component)
i = ClusterOutput(cluster_3.i)
item_1 = ClusterOutput(cluster_3.item_1)
length_mm = ClusterOutput(cluster_3.length_mm)
degrees = ClusterOutput(cluster_3.degrees_2)
index_supportpoints = ClusterOutput(cluster_2.index)
index_loadmembers = ClusterOutput(cluster_2.index_2)
index_loadnode_for_pointload = ClusterOutput(cluster_2.index_3)
result = ClusterOutput(merge_10)

# ---- group: BOOLEAN GATE VALUES
_1 = ClusterInput()
gate_2 = ClusterInput()
_1_2 = ClusterInput()
x_2 = ClusterInput()

# ---- group: ADDITIONAL GATES TO MANUALLY TURN ELEMENTS ON OR OFF
split_list = SplitList(List=stream_filter_6, Index=1)  # -> ListA, ListB
number_slider = Slider(1, range=0..1)
expression_3 = Expression(x=x_2, Expression="if(x=0,0,1)")
stream_filter_8 = StreamFilter(Gate=gate_2, Stream0=split_list.ListA, Stream1=_1)
stream_filter_9 = StreamFilter(Gate=expression_3, Stream0=Toggle(False), Stream1=Toggle(True))
stream_filter_10 = StreamFilter(Gate=expression_3, Stream0=[Slider(0, range=0..100), number_slider], Stream1=number_slider)
stream_filter_11 = StreamFilter(Gate=gate_2, Stream0=stream_filter_9, Stream1=_1_2)

# ---- group: GATE OUTCOMES
s_0 = ClusterOutput(stream_filter_11)
s_0_2 = ClusterOutput(stream_filter_8)
list_b = ClusterOutput(split_list.ListB)
s_0_3 = ClusterOutput(stream_filter_10)

# ==== cluster Cluster_7
A = ClusterInput()
B = ClusterInput()
multiplication = Multiplication(A=A, B=B)
multiplication_2 = Multiplication(A=multiplication, B=2)
multiplication_3 = Multiplication(A=multiplication_2, B=1000)
B_2 = ClusterInput()
division = Division(A=multiplication_3, B=B_2)
max_allowable_deflection = ClusterOutput(division)

# ==== cluster Cluster_8

# ---- group: Tension or compression
list = ClusterInput()

# ---- group: Heights
value = ClusterInput()

# ---- group: all lines
line = ClusterInput()

# ----
motion = ClusterInput()

# ---- group: Create volumes for visualization
absolute = Absolute(Value=value)
division = Division(A=simplify(1), B=100)
division_2 = Division(A=absolute, B=1000)
line_2 = Line(line)
expression = Expression(x=division_2, b=division, Expression="if(x=0,0,b)")
construct_domain = ConstructDomain(DomainStart=expr("-x", division_2), DomainEnd=division_2)
perp_frame = PerpFrame(Curve=line_2, Parameter=0)
equality = Equality(FirstNumber=expression, SecondNumber=0)  # -> Equality, Inequality
rectangle = Rectangle(Plane=perp_frame, XSize=expression, YSize=construct_domain, Radius=0)  # -> Rectangle, Length
dispatch = Dispatch(List=list, DispatchPattern=equality.Equality)  # -> ListA, ListB
sweep1 = Sweep1(Rail=graft(line_2), Sections=graft(rectangle.Rectangle), Miter=1)  # -> flatten(Brep)
dispatch_2 = Dispatch(List=sweep1, DispatchPattern=equality.Equality)  # -> ListA, ListB
equality_2 = Equality(FirstNumber=dispatch.ListB, SecondNumber=1)  # -> Equality, Inequality
dispatch_3 = Dispatch(List=line_2, DispatchPattern=equality.Equality)  # -> ListA, ListB
pipe = Pipe(Curve=dispatch_3.ListA, Radius=0.01, Caps=0)
dispatch_4 = Dispatch(List=dispatch_2.ListB, DispatchPattern=equality_2.Equality)  # -> ListA, ListB
move = Move(Geometry=pipe, Motion=motion)  # -> Geometry, Transform
move_2 = Move(Geometry=dispatch_4.ListA, Motion=motion)  # -> Geometry, Transform
move_3 = Move(Geometry=dispatch_4.ListB, Motion=motion)  # -> Geometry, Transform

# ---- group: Brep in tension
geometry = ClusterOutput(move_2.Geometry)

# ---- group: Brep in compression
geometry_2 = ClusterOutput(move_3.Geometry)

# ---- group: 'removed' elements
geometry_3 = ClusterOutput(move.Geometry)

# ==== cluster GenerativeDesign_2
panel = Panel("""None
Loadpath
Lmid
Ledge""")
panel_2 = Panel("""beam
truss""")
panel_3 = Panel("""None
Linear
Smooth""")

# ---- group: domains
list = ClusterInput()

# ---- group: Younpen gate
index = ClusterInput()

# ---- group: CC gate
index_2 = ClusterInput()

# ---- group: beam/truss gate
index_3 = ClusterInput()

# ----
list_item = ListItem(List=list, Index=0, Wrap=True)  # -> Item, Item1, Item2
list_item_2 = ListItem(List=panel_3, Index=index, Wrap=True)
list_item_3 = ListItem(List=panel, Index=index_2, Wrap=True)
list_item_4 = ListItem(List=panel_2, Index=index_3, Wrap=True)
prestress = ClusterInput()

# ---- group: Setup generative design / Create all possible combinations
cross_reference = CrossReference(
    ListDomain1=list_item.Item,
    ListDomain2=list_item.Item1,
    ListDomain3=list_item.Item2,
    ListYoungpen=list_item_2,
    ListPrestress=prestress,
    ListPrintlayers=list_item_3,
    ListBeamTruss=list_item_4,
    CrossMode=1)  # -> ListDomain1, ListDomain2, ListDomain3, ListYoungpen, ListPrestress, ListPrintlayers, ListBeamTruss

# ---- group: Setup generative design
index_0 = Slider(0, range=0..100)
list_length = ListLength(List=cross_reference.ListDomain1)
list_item_5 = ListItem(List=cross_reference.ListDomain1, Index=index_0, Wrap=True)
list_item_6 = ListItem(List=cross_reference.ListDomain2, Index=index_0, Wrap=True)
list_item_7 = ListItem(List=cross_reference.ListDomain3, Index=index_0, Wrap=True)
list_item_8 = ListItem(List=cross_reference.ListYoungpen, Index=index_0, Wrap=True)
list_item_9 = ListItem(List=cross_reference.ListPrestress, Index=index_0, Wrap=True)
list_item_10 = ListItem(List=cross_reference.ListPrintlayers, Index=index_0, Wrap=True)
list_item_11 = ListItem(List=cross_reference.ListBeamTruss, Index=index_0, Wrap=True)
entwine = Entwine(Branch00=list_item_5, Branch01=list_item_6, Branch02=list_item_7, FlattenInputs=True)  # -> flatten(Result)
expression = Expression(r=list_item_9, Expression="π*r^2 ")

# ----
i = ClusterOutput(list_item_8)
i_2 = ClusterOutput(list_item_10)
i_3 = ClusterOutput(list_item_11)
length = ClusterOutput(list_length)
result = ClusterOutput(entwine)
result_2 = ClusterOutput(expression)

# ==== cluster Cluster_9
y_component = ClusterInput()

# ---- group: Amount of control points
number = ClusterInput()

# ----
number_2 = ClusterInput()

# ---- group: create half bounding box
number_3 = Number(number_2)
number_4 = Number(number)
series = Series(Start=0, Step=number_3, Count=number_4)
vector_xyz = VectorXYZ(XComponent=0, YComponent=y_component, ZComponent=0)  # -> Vector, Length
construct_point = ConstructPoint(XCoordinate=series, YCoordinate=0, ZCoordinate=0)
move = Move(Geometry=construct_point, Motion=vector_xyz.Vector)  # -> Geometry, Transform
deconstruct = Deconstruct(Point=construct_point)  # -> XComponent, YComponent, ZComponent
deconstruct_2 = Deconstruct(Point=move.Geometry)  # -> XComponent, YComponent, ZComponent
entwine = Entwine(Branch00=construct_point, Branch01=move.Geometry, FlattenInputs=True)
merge = Merge(Data1=graft(deconstruct.YComponent), Data2=graft(deconstruct_2.YComponent))
flip_matrix = FlipMatrix(Data=entwine)
sort_list = SortList(Keys=merge, ValuesValuesA=flip_matrix)  # -> Keys, ValuesValuesA
list_item = ListItem(List=sort_list.ValuesValuesA, Index=-1, Wrap=True)
list_item_2 = ListItem(List=sort_list.ValuesValuesA, Index=0, Wrap=True)
polyline = PolyLine(Vertices=flatten(list_item_2), Closed=False)
polyline_2 = PolyLine(Vertices=flatten(list_item), Closed=False)
end_points = EndPoints(Curve=polyline_2)  # -> Start, End
end_points_2 = EndPoints(Curve=polyline)  # -> Start, End
relay = Relay([polyline, polyline_2])
line = Line(StartPoint=end_points.Start, EndPoint=end_points_2.Start)
line_2 = Line(StartPoint=end_points.End, EndPoint=end_points_2.End)
join_curves = JoinCurves(Curves=[line, line_2, polyline_2, polyline], Preserve=False)

# ---- group: Subdivision
number_5 = ClusterInput()

# ---- group: create subdivision within bounding box
number_6 = Number(number_5)
division = Division(A=1, B=number_6)
series_2 = Series(Start=division, Step=division, Count=expr("x-1", number_6))
clean_tree = CleanTree(RemoveNulls=True, RemoveInvalid=True, RemoveEmpty=False, Tree=series_2)
entwine_2 = Entwine(Branch00=flatten(list_item), Branch01=flatten(list_item_2), FlattenInputs=True)
tween_consecutive_points = TweenConsecutivePoints(Points=entwine_2, Factor=clean_tree, Weighted=False, Loopback=False, Degree=3, InterpolationType=0)
merge_2 = Merge(Data1=simplify(entwine_2), Data2=simplify(tween_consecutive_points))
flip_matrix_2 = FlipMatrix(Data=merge_2)
tween_consecutive_points_2 = TweenConsecutivePoints(Points=flip_matrix_2, Factor=clean_tree, Weighted=False, Loopback=False, Degree=3, InterpolationType=0)

# ---- group: Subdivisiontype
gate = ClusterInput()

# ---- group: generate crossrefernced model
stream_filter = StreamFilter(Gate=gate, Stream1=merge_2)
stream_filter_2 = StreamFilter(Gate=gate, Stream1=tween_consecutive_points_2)
stream_filter_3 = StreamFilter(Gate=gate, Stream1=list_item)
stream_filter_4 = StreamFilter(Gate=gate, Stream1=list_item_2)
cross_reference = CrossReference(
    ListB=flatten(stream_filter_3),
    ListA=flatten(stream_filter_4),
    ListListA=flatten(stream_filter),
    ListListB=flatten(stream_filter_2),
    CrossMode=1)  # -> ListB, ListA, ListListA, ListListB
line_3 = Line(StartPoint=cross_reference.ListListA, EndPoint=cross_reference.ListListB)
line_4 = Line(StartPoint=cross_reference.ListB, EndPoint=cross_reference.ListA)
merge_3 = Merge(Data1=line_4, Data2=line_3)
split_with_brep = SplitWithBrep(Curve=merge_3, Brep=join_curves)  # -> Curve, Points
list_length = ListLength(List=split_with_brep.Curve)
member_index = MemberIndex(Set=flatten(list_length), Member=1)  # -> Index, Count
tree_statistics = TreeStatistics(Tree=split_with_brep.Curve)  # -> Paths, Length, Count
list_item_3 = ListItem(List=tree_statistics.Paths, Index=member_index.Index, Wrap=True)
tree_branch = TreeBranch(Tree=split_with_brep.Curve, Path=list_item_3, MaintainPaths=True)
merge_4 = Merge(Data1=relay, Data2=tree_branch)  # -> flatten(Result)

# ---- group: Create structured grid
cluster = Cluster_5(_0_x=merge_2, data=tween_consecutive_points_2)
sort_points = SortPoints(Points=cluster)  # -> Points, Indices
graft_tree = GraftTree(Tree=sort_points.Points, IncludeEmptyLists=True, IncludeNullItems=True)  # -> simplify(Tree)
flip_matrix_3 = FlipMatrix(Data=sort_points.Points)
relative_item = RelativeItem(Tree=graft_tree, Offset="{-1;1}", WrapPaths=False, WrapItems=False)  # -> ItemA, ItemB
relative_item_2 = RelativeItem(Tree=graft_tree, Offset="{1;1}", WrapPaths=False, WrapItems=False)  # -> ItemA, ItemB
interpolate = Interpolate(Vertices=flip_matrix_3, Degree=1, Periodic=False, KnotStyle=1)  # -> Curve, Length, Domain
interpolate_2 = Interpolate(Vertices=sort_points.Points, Degree=1, Periodic=False, KnotStyle=1)  # -> Curve, Length, Domain
line_5 = Line(StartPoint=relative_item_2.ItemA, EndPoint=relative_item_2.ItemB)
line_6 = Line(StartPoint=relative_item.ItemA, EndPoint=relative_item.ItemB)
merge_5 = Merge(Data1=interpolate.Curve, Data2=interpolate_2.Curve, Data3=line_6, Data4=line_5)  # -> flatten(Result)

# ---- group: SPAN OF THE BRIDGE
expression = Expression(Dx=number_3, n=number_4, Expression="Dx*(n-1)*2")
unit_x = UnitX(Factor=expression)
list_item_4 = ListItem(List=construct_point, Index=0, Wrap=True)
move_2 = Move(Geometry=list_item_4, Motion=unit_x)  # -> Geometry, Transform
line_7 = Line(StartPoint=move_2.Geometry, EndPoint=list_item_4)

# ---- group: GENERATE ENTIRE STRUCTURE
list_item_5 = ListItem(List=construct_point, Index=-1, Wrap=True)
stream_filter_5 = StreamFilter(Gate=gate, Stream0=merge_5, Stream1=merge_4)
yz_plane = YZPlane(Origin=list_item_5)
mirror = Mirror(Geometry=join_curves, Plane=yz_plane)  # -> Geometry, Transform
mirror_2 = Mirror(Geometry=stream_filter_5, Plane=yz_plane)  # -> Geometry, Transform
merge_6 = Merge(Data1=stream_filter_5, Data2=line_7, Data3=mirror_2.Geometry)  # -> flatten(Result)
explode = Explode(Curve=merge_6, Recursive=True)  # -> flatten(Segments), Vertices
network_from_lines = NetworkFromLines(Lines=explode.Segments, Tolerance=0.1)  # -> PointPointTopology, ConnectionPointTopology, Points, Lines

# ----
lines = ClusterOutput(network_from_lines.Lines)

# ---- group: Desired construction constraint
x = ClusterInput()

# ---- group: FIND THE DESIRED CONSTRAINT MEMBERS
explode_2 = Explode(Curve=[mirror.Geometry, join_curves], Recursive=True)  # -> Segments, Vertices
curve_middle = CurveMiddle(Curve=line_7)
curve_middle_2 = CurveMiddle(Curve=explode_2.Segments)
deconstruct_3 = Deconstruct(Point=curve_middle_2)  # -> XComponent, YComponent, ZComponent
deconstruct_4 = Deconstruct(Point=curve_middle)  # -> XComponent, YComponent, ZComponent
removeduplicatelines = RemoveDuplicateLines(Lines=network_from_lines.Lines, Tolerance=0.01)
larger_than = LargerThan(FirstNumber=deconstruct_3.XComponent, SecondNumber=0)  # -> LargerThan, OrEqualTo
equality = Equality(FirstNumber=deconstruct_3.XComponent, SecondNumber=deconstruct_4.XComponent)  # -> Equality, Inequality
curve_middle_3 = CurveMiddle(Curve=removeduplicatelines)
gate_and = GateAnd(A=larger_than.LargerThan, B=equality.Equality)
point_plane_side = PointPlaneSide(Point=curve_middle_3, Plane=yz_plane)  # -> Side, Front, Back, Distance
collision_one_many = CollisionOneMany(Collider=curve_middle_3, Obstacles=line_7)  # -> Collision, Index
dispatch = Dispatch(List=explode_2.Segments, DispatchPattern=gate_and)  # -> ListA, flatten(ListB)
equality_2 = Equality(FirstNumber=point_plane_side.Distance, SecondNumber=0)  # -> Equality, Inequality
member_index_2 = MemberIndex(Set=collision_one_many.Collision, Member=True)  # -> Index, Count
collision_one_many_2 = CollisionOneMany(Collider=curve_middle_3, Obstacles=dispatch.ListB)  # -> Collision, Index
dispatch_2 = Dispatch(List=removeduplicatelines, DispatchPattern=equality_2.Equality)  # -> ListA, ListB
member_index_3 = MemberIndex(Set=collision_one_many_2.Collision, Member=True)  # -> Index, Count
member_index_4 = MemberIndex(Set=equality_2.Equality, Member=True)  # -> Index, Count
boolean_toggle = BooleanToggle(True)
expression_2 = Expression(x=x, Expression="if(x =\"Ledge\",3,if(x=\"Loadpath\",1,if(x=\"Lmid\",2,0)))")
merge_7 = Merge(Data1=boolean_toggle, Data2=flatten(member_index_4.Index))
merge_8 = Merge(Data1=boolean_toggle, Data2=flatten(member_index_2.Index), Data3=flatten(member_index_3.Index))
create_set = CreateSet(List=merge_7)  # -> Set, Map
create_set_2 = CreateSet(List=merge_8)  # -> Set, Map
stream_filter_6 = StreamFilter(
    Gate=expression_2,
    Stream0=Toggle(False),
    Stream1=flatten([member_index_2.Index, boolean_toggle]),
    Stream2=flatten(create_set.Set),
    Stream3=flatten(create_set_2.Set))

# ---- group: FIND PS MEMBERS
list_item_6 = ListItem(List=flatten(list_item_2), Index=1, Wrap=True)
shift_paths = ShiftPaths(Data=line_6, Offset=-1)
merge_9 = Merge(Data1=list_item_6, Data2=end_points_2.End)
polyline_3 = PolyLine(Vertices=merge_9, Closed=False)
list_item_7 = ListItem(List=shift_paths, Index=graft([2, 1, 0]), Wrap=True)  # -> flatten(Item)
end_points_3 = EndPoints(Curve=line_7)  # -> Start, End
member_index_5 = MemberIndex(Set=[end_points_3.Start, end_points_3.End], Member=end_points_2.Start)  # -> Index, Count
join_curves_2 = JoinCurves(Curves=[polyline_3, list_item_7], Preserve=False)
stream_filter_7 = StreamFilter(Gate=member_index_5.Count, Stream0=join_curves_2, Stream1=polyline)
mirror_3 = Mirror(Geometry=stream_filter_7, Plane=yz_plane)  # -> Geometry, Transform
join_curves_3 = JoinCurves(Curves=[mirror_3.Geometry, stream_filter_7], Preserve=False)
collision_one_many_3 = CollisionOneMany(Collider=curve_middle_3, Obstacles=join_curves_3)  # -> Collision, Index
member_index_6 = MemberIndex(Set=collision_one_many_3.Collision, Member=True)  # -> Index, Count
list_item_8 = ListItem(List=removeduplicatelines, Index=member_index_6.Index, Wrap=True)

# ---- group: indices of PS members
index = ClusterOutput(member_index_6.Index)

# ---- group: visualize PS member
line_8 = Line(list_item_8)

# ---- group: Data that needs to be duplicated for each member
_0_0 = ClusterInput()
_0_1 = ClusterInput()
_0_2 = ClusterInput()

# ---- group: printwidth + amount of paths
A = ClusterInput()
B = ClusterInput()

# ---- group: input pointloads
d1 = ClusterInput()
d2 = ClusterInput()

# ----
line_9 = Line(network_from_lines.Lines)

# ---- group: Calculations before python|data manipulation for python
# optional to set a Pointload
point = Point(network_from_lines.Points)
entwine_3 = Entwine(Branch00=_0_0, Branch01=_0_1, Branch02=_0_2, FlattenInputs=True)
list_length_2 = ListLength(List=line_9)
cluster_2 = Cluster_3(curve=line_7, points=point, curve_2=dispatch_2.ListA, curve_3=line_9)  # -> index, index_3, index_2
duplicate_data = DuplicateData(Data=entwine_3, Number=list_length_2, Order=True)
cluster_3 = Cluster_4(point=point, list=network_from_lines.ConnectionPointTopology, curve_2=line_9, curve=line_9)  # -> x_component, y_component, i, item_1, length_mm, degrees_2
explode_tree = ExplodeTree(Data=duplicate_data)  # -> Branch0, Branch1, Branch2
merge_10 = Merge(Data1=d1, Data2=d2)
multiplication = Multiplication(A=A, B=B)

# ----
_0_2_0 = ClusterOutput(explode_tree.Branch2)
_0_0_0 = ClusterOutput(explode_tree.Branch0)
_0_1_0 = ClusterOutput(explode_tree.Branch1)
manup = ClusterOutput(multiplication)
x_component = ClusterOutput(cluster_3.x_component)
y_component_2 = ClusterOutput(cluster_3.y_component)
i = ClusterOutput(cluster_3.i)
item_1 = ClusterOutput(cluster_3.item_1)
length_mm = ClusterOutput(cluster_3.length_mm)
degrees = ClusterOutput(cluster_3.degrees_2)
index_supportpoints = ClusterOutput(cluster_2.index)
index_loadmembers = ClusterOutput(cluster_2.index_2)
index_loadnode_for_pointload = ClusterOutput(cluster_2.index_3)
result = ClusterOutput(merge_10)

# ---- group: BOOLEAN GATE VALUES
_1 = ClusterInput()
gate_2 = ClusterInput()
_1_2 = ClusterInput()
x_2 = ClusterInput()

# ---- group: ADDITIONAL GATES TO MANUALLY TURN ELEMENTS ON OR OFF
split_list = SplitList(List=stream_filter_6, Index=1)  # -> ListA, ListB
number_slider = Slider(1, range=0..1)
expression_3 = Expression(x=x_2, Expression="if(x=0,0,1)")
stream_filter_8 = StreamFilter(Gate=gate_2, Stream0=split_list.ListA, Stream1=_1)
stream_filter_9 = StreamFilter(Gate=expression_3, Stream0=Toggle(False), Stream1=Toggle(True))
stream_filter_10 = StreamFilter(Gate=expression_3, Stream0=[Slider(0, range=0..100), number_slider], Stream1=number_slider)
stream_filter_11 = StreamFilter(Gate=gate_2, Stream0=stream_filter_9, Stream1=_1_2)

# ---- group: GATE OUTCOMES
s_0 = ClusterOutput(stream_filter_11)
s_0_2 = ClusterOutput(stream_filter_8)
list_b = ClusterOutput(split_list.ListB)
s_0_3 = ClusterOutput(stream_filter_10)

# ==== cluster Cluster_3

# ---- group: all points
points = ClusterInput()

# ---- group: span curve
curve = ClusterInput()

# ---- group: curve at mirror point
curve_2 = ClusterInput()

# ---- group: all curves
curve_3 = ClusterInput()

# ---- group: find loadpath members
curve_middle = CurveMiddle(Curve=curve_3)
xz_plane = XZPlane(Origin=Point(0, 0, 0))
point_plane_side = PointPlaneSide(Point=curve_middle, Plane=xz_plane)  # -> Side, Front, Back, Distance
equality = Equality(FirstNumber=point_plane_side.Side, SecondNumber=0)  # -> Equality, Inequality
member_index = MemberIndex(Set=equality.Equality, Member=True)  # -> Index, Count

# ---- group: find pointload points
end_points = EndPoints(Curve=curve_2)  # -> Start, End
removeduplicatepts = RemoveDuplicatePts(Points=[end_points.Start, end_points.End], Tolerance=0.01)
deconstruct = Deconstruct(Point=removeduplicatepts)  # -> XComponent, YComponent, ZComponent
highest_lowest_numbers = HighestLowestNumbers(Numbers=deconstruct.YComponent)  # -> Highest, Lowest
member_index_2 = MemberIndex(Set=deconstruct.YComponent, Member=graft([highest_lowest_numbers.Highest, highest_lowest_numbers.Lowest]))  # -> Index, Count
list_item = ListItem(List=removeduplicatepts, Index=member_index_2.Index, Wrap=True)
deconstruct_2 = Deconstruct(Point=flatten(list_item))  # -> XComponent, YComponent, ZComponent
highest_lowest_numbers_2 = HighestLowestNumbers(Numbers=deconstruct_2.YComponent)  # -> Highest, Lowest
key_value_search = KeyValueSearch(Keys=deconstruct_2.YComponent, Values=flatten(list_item), Search=highest_lowest_numbers_2.Highest)
member_index_3 = MemberIndex(Set=points, Member=key_value_search)  # -> flatten(Index), Count

# ---- group: find support points
end_points_2 = EndPoints(Curve=curve)  # -> Start, End
member_index_4 = MemberIndex(Points=points, Member=[end_points_2.Start, end_points_2.End])  # -> flatten(Index), Count

# ---- group: support indices
index = ClusterOutput(member_index_4.Index)

# ---- group: loadpath members
index_2 = ClusterOutput(member_index.Index)

# ---- group: pointload indices
index_3 = ClusterOutput(member_index_3.Index)

# ==== cluster Cluster_4

# ---- group: all points
point = ClusterInput()

# ----
list = ClusterInput()
curve = ClusterInput()
curve_2 = ClusterInput()

# ---- group: Geometrical properties: X,Y node | Node numbers elements | Lengths elements | Angles elements
end_points = EndPoints(Curve=curve)  # -> Start, End
unit_x = UnitX(Factor=1)
vector_2pt = Vector2Pt(PointA=end_points.Start, PointB=end_points.End, Unitize=False)  # -> Vector, Length
xy_plane = XYPlane(Origin=Point(0, 0, 0))
angle = Angle(VectorA=vector_2pt.Vector, VectorB=unit_x, Plane=xy_plane)  # -> Angle, Reflex
length = Length(Curve=curve_2)
deconstruct = Deconstruct(Point=point)  # -> XComponent, YComponent, ZComponent
degrees = Degrees(Radians=angle.Reflex)
multiplication = Multiplication(A=length, B=1000)
list_item = ListItem(List=list, Index=0, Wrap=True)  # -> Item, Item1

# ----
degrees_2 = ClusterOutput(degrees)
i = ClusterOutput(list_item.Item)
item_1 = ClusterOutput(list_item.Item1)
length_mm = ClusterOutput(multiplication)
x_component = ClusterOutput(deconstruct.XComponent)
y_component = ClusterOutput(deconstruct.YComponent)

# ==== cluster Cluster_5
data = ClusterInput()
flip_matrix = FlipMatrix(Data=data)
_0_x = ClusterInput()
entwine = Entwine(Branch0X=_0_x, Branch1X=flip_matrix, FlattenInputs=False)
tree_statistics = TreeStatistics(Tree=entwine)  # -> Paths, Length, Count
list_item = ListItem(List=entwine, Index=0, Wrap=True)
deconstruct = Deconstruct(Point=list_item)  # -> XComponent, flatten(YComponent), ZComponent
sort_list = SortList(Keys=deconstruct.YComponent, ValuesValuesA=tree_statistics.Paths)  # -> Keys, ValuesValuesA
tree_branch = TreeBranch(Tree=entwine, Path=sort_list.ValuesValuesA, MaintainPaths=False)
branch = ClusterOutput(tree_branch)
